# Dynamo graph FT-Excel匯入[柱樑板牆].dyn (Dynamo 2.19.3.6394)
# author: CHIUNG YING
# ✨操作說明：需輸入相關資訊/準備 CSV 檔案 / 選取各檔案路徑 / 執行與檢查結果。

請選取_柱_csv_檔案路徑 = Filename("C:\Users\002700\Downloads\SRC柱鋼構尺寸彙整表_新格式.csv")  # graph input
python_script = Python(IN[0]=請選取_柱_csv_檔案路徑)  # CPython3; unwired: IN[1], IN[2], IN[3]
# ---------- python_script.python (130 lines) ----------
# -*- coding: utf-8 -*-
import clr
import os
import System
import unicodedata

clr.AddReference('RevitAPI')
from Autodesk.Revit.DB import *
clr.AddReference('RevitServices')
from RevitServices.Persistence import DocumentManager
from RevitServices.Transactions import TransactionManager

doc = DocumentManager.Instance.CurrentDBDocument
# --- 修改點：收集所有 IN 埠傳進來的路徑 ---
raw_paths = IN if isinstance(IN, list) else [IN]
paths = [str(p).strip() for p in raw_paths if p]
results = []

def clean_str(s):
    if not s: return ""
    s = str(s).strip().replace('"', '')
    return "".join(ch for ch in s if unicodedata.category(ch)[0] != 'C')

def to_ft(val):
    try:
        if not val or val == "": return None
        clean_val = "".join(c for c in str(val) if c.isdigit() or c == '.')
        return System.Double(float(clean_val) / 304.8)
    except: return None

# 執行核心邏輯
TransactionManager.Instance.EnsureInTransaction(doc)
try:
    # 預先整理系統類型地圖
    all_walls = {w.get_Parameter(BuiltInParameter.SYMBOL_NAME_PARAM).AsString(): w 
                 for w in FilteredElementCollector(doc).OfClass(WallType) if w.Kind == WallKind.Basic}
    all_floors = {f.get_Parameter(BuiltInParameter.SYMBOL_NAME_PARAM).AsString(): f 
                  for f in FilteredElementCollector(doc).OfClass(FloorType) if not f.IsFoundationSlab}

    def get_sys_template(cat, t_name):
        if "牆" in cat:
            return next((w for n, w in all_walls.items() if any(k in n for k in ["一般", "Generic"])), next(iter(all_walls.values()), None))
        else:
            if "高腳杯" in t_name: return next((f for n, f in all_floors.items() if "高腳杯" in n), None)
            elif "ㄇ字型" in t_name: return next((f for n, f in all_floors.items() if "ㄇ字型" in n), None)
            return next((f for n, f in all_floors.items() if "FT-S" in n), next(iter(all_floors.values()), None))

    # --- 修改點：多檔案循環 ---
    for csv_path in paths:
        if not os.path.exists(csv_path): continue
        
        file_name = os.path.basename(csv_path)
        rows = []
        try:
            for enc in ['utf-8-sig', 'cp950']:
                try:
                    with open(csv_path, 'r', encoding=enc) as f:
                        for line in f:
                            parts = [clean_str(p) for p in line.split(',')]
                            if len(parts) >= 2 and parts[1]: rows.append(parts)
                    break
                except: continue
            results.append(f"📂 讀取檔案: {file_name} ({len(rows)}列)")
        except: continue

        if len(rows) <= 2: continue

        for i, row in enumerate(rows[2:]):
            try:
                cat_or_fam, type_name = row[0], row[1]
                
                # 分支一：牆、板
                if any(k in cat_or_fam for k in ["牆", "板", "Floor", "Wall"]):
                    is_wall = "牆" in cat_or_fam or "Wall" in cat_or_fam
                    target = all_walls.get(type_name) if is_wall else all_floors.get(type_name)
                    
                    if target is None:
                        template = get_sys_template(cat_or_fam, type_name)
                        if template:
                            target = template.Duplicate(type_name)
                            if is_wall: all_walls[type_name] = target
                            else: all_floors[type_name] = target
                            res_msg = f"✨ 新建系統: {type_name}"
                        else: continue
                    else: res_msg = f"🔄 更新系統: {type_name}"

                    val_ft = to_ft(row[2])
                    if val_ft and target:
                        cs = target.GetCompoundStructure()
                        if cs:
                            cs.SetLayerWidth(cs.GetFirstCoreLayerIndex(), val_ft)
                            target.SetCompoundStructure(cs)
                            results.append(f"  {res_msg} (厚度: {row[2]}mm)")

                # 分支二：載入式族群 (柱、樑)
                else:
                    collector = FilteredElementCollector(doc).OfClass(Family).ToElements()
                    target_fam = next((f for f in collector if f.Name == cat_or_fam), None)
                    if target_fam:
                        symbol_ids = target_fam.GetFamilySymbolIds()
                        symbols = [doc.GetElement(s_id) for s_id in symbol_ids]
                        target_type = next((s for s in symbols if s.get_Parameter(BuiltInParameter.SYMBOL_NAME_PARAM).AsString() == type_name), None)
                        
                        if not target_type:
                            target_type = symbols[0].Duplicate(type_name)
                            res_msg = f"✨ 新建類型: {type_name}"
                        else: res_msg = f"🔄 更新類型: {type_name}"

                        if not target_type.IsActive: target_type.Activate()
                        
                        param_mapping = {"X": 2, "b": 2, "寬度": 2, "Y": 3, "h": 3, "高度": 3, "直徑": 4, "Ø": 4}
                        applied = []
                        for p_name, col_idx in param_mapping.items():
                            if len(row) > col_idx:
                                v_ft = to_ft(row[col_idx])
                                if v_ft:
                                    p = target_type.LookupParameter(p_name)
                                    if not p and p_name in ["h", "高度"]:
                                        p = target_type.get_Parameter(BuiltInParameter.STRUCTURAL_BEAM_HEIGHT)
                                    if p and not p.IsReadOnly:
                                        p.Set(v_ft)
                                        applied.append(p_name)
                        results.append(f"  {res_msg} (參數: {','.join(list(set(applied))) if applied else '無'})")
            except: continue

except Exception as e:
    results.append(f"🔥 執行錯誤: {str(e)}")
TransactionManager.Instance.TransactionTaskDone()

OUT = results
# ----------------------------------------
請選取_樑_csv_檔案路徑 = Filename("D:\dynamo\Excel\Excel 匯入 Revit 整合-04070樑.csv")  # graph input
請選取_板_csv_檔案路徑 = Filename("D:\dynamo\Excel\Excel 匯入 Revit 整合-04070板.csv")  # graph input
請選取_牆_csv_檔案路徑 = Filename("D:\dynamo\Excel\Excel 匯入 Revit 整合-04070牆.csv")  # graph input
