# Dynamo graph FT-Excel匯入[柱樑板牆]加強版.dyn (Dynamo 2.19.3.6394)
# author: CHIUNG YING
# ✨操作說明：需輸入相關資訊/準備 CSV 檔案 / 選取各檔案路徑 / 執行與檢查結果。

請選取_柱_csv_檔案路徑 = Filename("C:\Users\002700\Downloads\Revit匯入表_v2.csv")  # graph input
python_script = Python(IN[0]=請選取_柱_csv_檔案路徑)  # CPython3; unwired: IN[1], IN[2], IN[3]
# ---------- python_script.python (98 lines) ----------
# -*- coding: utf-8 -*-
import clr
import os
import System

clr.AddReference('RevitAPI')
from Autodesk.Revit.DB import *

clr.AddReference('RevitServices')
from RevitServices.Persistence import DocumentManager
from RevitServices.Transactions import TransactionManager

doc = DocumentManager.Instance.CurrentDBDocument

def to_ft(val):
    try:
        if val is None: return None
        s = "".join(c for c in str(val) if c.isdigit() or c in ".-")
        if not s: return None
        return float(s) / 304.8
    except: return None

# 讀取輸入路徑
paths = [str(p).strip() for p in IN if p] if isinstance(IN, list) else ([str(IN).strip()] if IN else [])
results = []

TransactionManager.Instance.EnsureInTransaction(doc)

try:
    for csv_path in paths:
        if not os.path.exists(csv_path): continue
        
        file_name = os.path.basename(csv_path)
        import io
        rows = []
        with io.open(csv_path, 'r', encoding='utf-8-sig') as f:
            for line in f:
                parts = [p.strip() for p in line.split(',')]
                if len(parts) >= 2 and parts[1]: rows.append(parts)

        if len(rows) <= 3: continue
        results.append("📂 檔案: " + file_name)

        # --- 根據檔案名稱決定對應邏輯 ---
        # 區分 樑(Beam) 與 柱(Column) 的欄位索引
        mode = "COLUMN" if "柱" in file_name else "BEAM"

        for i, row in enumerate(rows[3:]):
            try:
                fam_name, type_name = row[0], row[1]
                collector = FilteredElementCollector(doc).OfClass(Family).ToElements()
                target_fam = next((f for f in collector if f.Name == fam_name), None)
                if not target_fam: continue

                symbols = [doc.GetElement(s_id) for s_id in target_fam.GetFamilySymbolIds()]
                target_type = next((s for s in symbols if s.get_Parameter(BuiltInParameter.SYMBOL_NAME_PARAM).AsString() == type_name), None)
                if not target_type: target_type = symbols[0].Duplicate(type_name)
                if not target_type.IsActive: target_type.Activate()

                # 定義該族群所有可用的參數字典
                p_dict = {p.Definition.Name.lower(): p for p in target_type.Parameters}

                applied = []
                
                # 配置映射表格
                if mode == "BEAM":
                    # 樑：C=b(2), D=h(3), E=tw(4), F=tf(5)
                    mapping = [(2, ["b", "寬度"]), (3, ["h", "高度"]), (4, ["tw", "腹板厚度"]), (5, ["tf", "翼板厚度"])]
                else:
                    # 柱：C=b(2), D=h(3), E=直徑(4), F=tw(5), G=tf(6), H=t1(7), I=t2(8), J=灌漿X(9), K=灌漿Y(10)
                    mapping = [(2, ["b", "X"]), (3, ["h", "Y"]), (4, ["直徑"]), (5, ["tw"]), (6, ["tf"]), 
                               (7, ["t1", "t"]), (8, ["t2"]), (9, ["柱內灌漿X"]), (10, ["柱內灌漿Y"])]

                for col_idx, names in mapping:
                    if len(row) > col_idx:
                        val_ft = to_ft(row[col_idx])
                        if val_ft is None: continue
                        
                        # 嘗試匹配正確的參數名稱
                        target_p = None
                        for name in names:
                            if name.lower() in p_dict:
                                target_p = p_dict[name.lower()]
                                break
                        
                        if target_p and not target_p.IsReadOnly:
                            target_p.Set(val_ft)
                            applied.append(target_p.Definition.Name)

                results.append("  ✅ {}: ({})".format(type_name, ",".join(applied)))
            except Exception as e_row:
                results.append("  ❌ 列 {} 錯誤: {}".format(i+4, str(e_row)))

except Exception as e_global:
    results.append("🔥 嚴重錯誤: " + str(e_global))

TransactionManager.Instance.TransactionTaskDone()
OUT = results
# ----------------------------------------
請選取_樑_csv_檔案路徑 = Filename("D:\dynamo\Excel\Excel 匯入 Revit 整合-樑.csv")  # graph input
請選取_板_csv_檔案路徑 = Filename("D:\dynamo\Excel\Excel 匯入 Revit 整合-04070板.csv")  # graph input
請選取_牆_csv_檔案路徑 = Filename("D:\dynamo\Excel\Excel 匯入 Revit 整合-04070牆.csv")  # graph input
