# Dynamo graph FT-刪除圖紙及元件.dyn (Dynamo 2.19.3.6394)
# author: CHIUNG YING
# 🔄操作說明：開啟檔案/執行/自動另存新檔_Purge。

python_script = Python()  # CPython3; unwired: IN[0]
# ---------- python_script.python (95 lines) ----------
import clr
import os

clr.AddReference('RevitAPI')
from Autodesk.Revit.DB import *

clr.AddReference('RevitServices')
import RevitServices
from RevitServices.Persistence import DocumentManager
from RevitServices.Transactions import TransactionManager

doc = DocumentManager.Instance.CurrentDBDocument

# --- 1. 路徑處理 ---
current_path = doc.PathName

if not current_path:
    OUT = "❌ 錯誤：檔案尚未儲存，請先手動儲存原始檔。"
else:
    try:
        folder = os.path.dirname(current_path)
        filename = os.path.basename(current_path)
        name, ext = os.path.splitext(filename)
        new_path = os.path.join(folder, name + "_Purge" + ext)

        # --- 2. 核心操作：先另存新檔 ---
        # 這樣接下來的所有動作都是在 _Purge 這個副本上進行
        save_opts = SaveAsOptions()
        save_opts.OverwriteExistingFile = True
        save_opts.Compact = True
        
        if doc.IsWorkshared:
            ws_options = WorksharingSaveAsOptions()
            ws_options.SaveAsCentral = True 
            save_opts.SetWorksharingOptions(ws_options)

        # 立即執行另存
        doc.SaveAs(new_path, save_opts)

        # --- 3. 開始清理作業 ---
        TransactionManager.Instance.EnsureInTransaction(doc)
        
        sheet_count = 0
        view_count = 0

        # A. 刪除圖紙
        sheets = FilteredElementCollector(doc).OfClass(ViewSheet).ToElements()
        for s in sheets:
            if s and s.IsValidObject:
                try:
                    if s.Pinned: s.Pinned = False
                    doc.Delete(s.Id)
                    sheet_count += 1
                except: pass

        # B. 刪除非必要視圖
        views = FilteredElementCollector(doc).OfClass(View).ToElements()
        active_view_id = doc.ActiveView.Id
        for v in views:
            if v and v.IsValidObject:
                if v.IsTemplate or v.Id == active_view_id: continue
                if v.CanBePrinted or v.ViewType == ViewType.Section:
                    try:
                        if v.Pinned: v.Pinned = False
                        doc.Delete(v.Id)
                        view_count += 1
                    except: pass

        # C. 深度 Purge
        for i in range(2):
            try:
                from System.Collections.Generic import List as ListGen
                unused = doc.GetUnusedElements(ListGen[ElementId]())
            except:
                try: unused = doc.GetUnusedElements(ElementId.InvalidElementId)
                except: unused = []
            
            if not unused: break
            for u_id in unused:
                try: doc.Delete(u_id)
                except: pass

        TransactionManager.Instance.TransactionTaskDone()

        # --- 4. 修改完畢後存檔 ---
        doc.Save()
        
        OUT = "🛡️ 清理完成！\n" + \
              "1. 檔案已產出: {}\n".format(name + "_Purge" + ext) + \
              "2. 刪除圖紙: {} 張\n".format(sheet_count) + \
              "3. 刪除視圖: {} 個".format(view_count)

    except Exception as ex:
        if TransactionManager.Instance.TransactionTaskDone(): pass
        OUT = "❌ 執行失敗: " + str(ex)
# ----------------------------------------
