# Dynamo graph FT-匯出NWC.dyn (Dynamo 2.19.3.6394)
# author: CHIUNG YING
# 🔄操作說明：開啟檔案/執行/自動匯出NWC。

python_script = Python()  # CPython3; unwired: IN[0]
# ---------- python_script.python (55 lines) ----------
import clr
import os

# 引用 Revit API
clr.AddReference('RevitAPI')
from Autodesk.Revit.DB import *

# 引用 Revit 服務
clr.AddReference('RevitServices')
from RevitServices.Persistence import DocumentManager

# 取得目前的 Revit 文件
doc = DocumentManager.Instance.CurrentDBDocument

try:
    # 1. 處理檔案路徑與檔名
    if doc.IsModelInCloud:
        # 如果是 BIM 360/ACC 雲端模型，預設匯出到桌面
        folder = os.path.join(os.environ['USERPROFILE'], 'Desktop')
        nwc_name = doc.Title
    else:
        # 本地檔案則匯出至同資料夾
        current_path = doc.PathName
        folder = os.path.normpath(os.path.dirname(current_path))
        filename = os.path.basename(current_path)
        nwc_name = os.path.splitext(filename)[0]

    # 2. 設定 NWC 匯出選項 (依據截圖設定)
    nwc_opt = NavisworksExportOptions()
    
    # 匯出範圍：目前視圖
    nwc_opt.ExportScope = NavisworksExportScope.View
    nwc_opt.ViewId = doc.ActiveView.Id
    
    # --- 座標設定：專案內部 (Project Internal) ---
    nwc_opt.Coordinates = NavisworksCoordinates.Internal
    
    # --- 關鍵參數設定 (對應圖片中的勾選項) ---
    nwc_opt.ConvertElementProperties = True      # 元素的類型性質
    nwc_opt.FacetingFactor = 1.0                 # 刻面係數
    nwc_opt.ExportLinks = True                   # 包含連結檔
    nwc_opt.DivideFileIntoLevels = True          # 將檔案分割為多個層級 (截圖中有勾選)
    nwc_opt.ConvertRoomsToAttributes = True      # 將房間轉換為屬性
    nwc_opt.ExportRoomGeometry = True            # 匯出房間幾何圖形
    nwc_opt.ExportParts = True                   # 匯出零件
    nwc_opt.FindMissingMaterials = False         # 嘗試尋找遺失材料 (截圖未勾選)

    # 3. 執行匯出
    # Revit Export 方法會自動處理副檔名，nwc_name 不需要加 ".nwc"
    doc.Export(folder, nwc_name, nwc_opt)

    OUT = "✅ NWC 匯出成功！\n路徑：{}\n檔名：{}.nwc\n座標系統：專案內部\n包含連結檔：是".format(folder, nwc_name)

except Exception as ex:
    OUT = "❌ 失敗：{}\n類型：{}".format(str(ex), type(ex).__name__)
# ----------------------------------------
