# Dynamo graph FT-建立網格.dyn (Dynamo 2.19.3.6394)
# author: CHIUNG YING
# ✨操作說明：需輸入相關資訊

網格CAD圖層 = StringInput("\"CCL\"")  # graph input
垂直起始名稱 = StringInput("f1")  # graph input
水平起始名稱 = StringInput("P6-A")  # graph input
python_script = Python(IN[0]=網格CAD圖層, IN[2]=垂直起始名稱, IN[3]=水平起始名稱)  # CPython3; unwired: IN[1]
# ---------- python_script.python (151 lines) ----------
# -*- coding: utf-8 -*-
import clr, math, re

clr.AddReference("RevitAPI")
clr.AddReference("RevitServices")

from RevitServices.Persistence import DocumentManager
from RevitServices.Transactions import TransactionManager
from Autodesk.Revit.DB import (
    FilteredElementCollector, ImportInstance, Grid,
    Options, GeometryInstance, GraphicsStyle, Line, XYZ
)

doc = DocumentManager.Instance.CurrentDBDocument

# ── 1. 讀取輸入 (請確保節點有 4 個 IN 埠) ─────────────────────────
def get_input(index, default):
    try: return str(IN[index]).strip() if IN[index] else default
    except: return default

v_layer_input = get_input(0, "ccl").lower()
h_layer_input = get_input(1, "ccl").lower()
v_start_name  = get_input(2, "f1")
h_start_name  = get_input(3, "P6-A")

log = []
log.append("設定 - 垂直圖層:{} 起始:{}".format(v_layer_input, v_start_name))
log.append("設定 - 水平圖層:{} 起始:{}".format(h_layer_input, h_start_name))

# ── 2. 命名產生器 (修正：確保 f1 優先被數字規則捕獲) ────────────────
def make_name_gen(start_name):
    # 規則 A：數字結尾 (如 f1, 1, Grid1) -> 最優先
    m_num = re.match(r'^(.*?)(\d+)$', start_name)
    if m_num:
        prefix, num = m_num.group(1), int(m_num.group(2))
        return lambda i: prefix + str(num + i)

    # 規則 B：字母結尾 (如 P6-A, A)
    m_alpha = re.match(r'^(.*?)([A-Za-z])$', start_name)
    if m_alpha:
        prefix, alpha = m_alpha.group(1), m_alpha.group(2).upper()
        start_i = ord(alpha) - ord('A')
        def gen_alpha(i):
            idx = start_i + i
            if idx <= 25: return prefix + chr(ord('A') + idx)
            return prefix + chr(ord('A')+(idx//26)-1) + chr(ord('A')+(idx%26))
        return gen_alpha

    return lambda i: start_name + str(i+1)

v_gen = make_name_gen(v_start_name)
h_gen = make_name_gen(h_start_name)

# ── 3. 幾何收集與遞迴遍歷 ─────────────────────────────
def get_all_lines(doc, target_layers):
    opt = Options()
    opt.IncludeNonVisibleObjects = True
    results = []
    
    collector = FilteredElementCollector(doc).OfClass(ImportInstance).ToElements()
    for cad in collector:
        geo = cad.get_Geometry(opt)
        if not geo: continue
        
        def process(geo_list):
            inner_results = []
            for o in geo_list:
                if isinstance(o, GeometryInstance):
                    inner_results.extend(process(o.GetInstanceGeometry()))
                elif isinstance(o, Line):
                    if not hasattr(o, "GraphicsStyleId"): continue
                    style = doc.GetElement(o.GraphicsStyleId)
                    if not style: continue
                    
                    full_name = style.GraphicsStyleCategory.Name.lower()
                    # 圖層模糊匹配
                    matched = next((l for l in target_layers if l in full_name), None)
                    if matched:
                        p0, p1 = o.GetEndPoint(0), o.GetEndPoint(1)
                        # 只取水平面上的線 (Z值相近)
                        if abs(p0.Z - p1.Z) < 0.1:
                            inner_results.append((matched, p0, p1))
            return inner_results
        
        results.extend(process(geo))
    return results

raw_data = get_all_lines(doc, {v_layer_input, h_layer_input})

# ── 4. 去重與精確分類 ────────────────────────────────
def dedup_and_classify(data):
    v_out, h_out = [], []
    used_mids = []
    
    for layer, p0, p1 in data:
        # 計算中點用於去重
        mid = XYZ((p0.X+p1.X)/2, (p0.Y+p1.Y)/2, 0)
        if any(mid.DistanceTo(prev) < 1.0 for prev in used_mids): continue
        used_mids.append(mid)
        
        dx = abs(p1.X - p0.X)
        dy = abs(p1.Y - p0.Y)
        
        # 核心判定：dy > dx 絕對是垂直線 (Vertical)
        if dy > dx:
            v_out.append((p0, p1))
        else:
            h_out.append((p0, p1))
    return v_out, h_out

v_lines, h_lines = dedup_and_classify(raw_data)

# ── 5. 排序 (針對你的圖面習慣修正) ────────────────────────
# 垂直軸網 (f1 系列)：由左至右排 (X 從小到大)
final_v = sorted(v_lines, key=lambda pts: (pts[0].X + pts[1].X)/2)

# 水平軸網 (P6-A 系列)：由上至下排 (Y 從大到小，解決 AD 在下面的問題)
final_h = sorted(h_lines, key=lambda pts: (pts[0].Y + pts[1].Y)/2, reverse=True)

log.append("偵測結果 - 垂直:{} 條, 水平:{} 條".format(len(final_v), len(final_h)))

# ── 6. 建立 Revit 軸網 ─────────────────────────────
existing_names = set(g.Name for g in FilteredElementCollector(doc).OfClass(Grid))

TransactionManager.Instance.EnsureInTransaction(doc)

# 建立垂直軸網 (f1...)
for i, (p0, p1) in enumerate(final_v):
    try:
        g = Grid.Create(doc, Line.CreateBound(XYZ(p0.X, p0.Y, 0), XYZ(p1.X, p1.Y, 0)))
        name = v_gen(i)
        while name in existing_names: name += "'"
        g.Name = name
        existing_names.add(name)
        log.append("✅ 垂直: {}".format(name))
    except Exception as ex: log.append("❌ 垂直失敗: {}".format(ex))

# 建立水平軸網 (P6-A...)
for i, (p0, p1) in enumerate(final_h):
    try:
        g = Grid.Create(doc, Line.CreateBound(XYZ(p0.X, p0.Y, 0), XYZ(p1.X, p1.Y, 0)))
        name = h_gen(i)
        while name in existing_names: name += "'"
        g.Name = name
        existing_names.add(name)
        log.append("✅ 水平: {}".format(name))
    except Exception as ex: log.append("❌ 水平失敗: {}".format(ex))

TransactionManager.Instance.TransactionTaskDone()

OUT = log
# ----------------------------------------
watch = Watch(python_script)
水平圖層 = StringInput("CCL")
