# Dynamo graph FT-批量連結.dyn (Dynamo 2.19.3.6394)
# ✨操作說明：需輸入相關資訊 / 檔案選取(可批量選取) / 執行與檢查結果。

檔案選取 = Directory("D:\富螎_模型")  # graph input
directory_from_path = DirectoryObject(path=檔案選取)
string = StringInput("*.rvt")
boolean = BoolSelector(false)
getDirectoryContents = FileSystem.GetDirectoryContents(directory=directory_from_path, searchString=string, includeSubdirectories=boolean)
python_script = Python(IN[0]=getDirectoryContents.files)  # IronPython2
# ---------- python_script.python (27 lines) ----------
# -*- coding: utf-8 -*-
import clr
import os
clr.AddReference('RevitAPI')
from Autodesk.Revit.DB import *
clr.AddReference('RevitServices')
import RevitServices
from RevitServices.Persistence import DocumentManager
from RevitServices.Transactions import TransactionManager

doc = DocumentManager.Instance.CurrentDBDocument
input_data = IN[0]
paths = input_data if isinstance(input_data, list) else [input_data]
output_log = []

TransactionManager.Instance.EnsureInTransaction(doc)
for p in paths:
    try:
        m_path = ModelPathUtils.ConvertUserVisiblePathToModelPath(str(p))
        # 僅執行連結與放置 (使用原點對位)
        link_type_id = RevitLinkType.Create(doc, m_path, RevitLinkOptions(False)).ElementId
        RevitLinkInstance.Create(doc, link_type_id, ImportPlacement.Origin)
        output_log.append("成功載入: " + os.path.basename(str(p)))
    except Exception as e:
        output_log.append("跳過: " + os.path.basename(str(p)))
TransactionManager.Instance.TransactionTaskDone()
OUT = output_log
# ----------------------------------------
