# Dynamo graph FT-選取調色.dyn (Dynamo 2.19.3.6394)
# author: CHIUNG YING
# ✨操作說明：需輸入相關資訊(RGB色號)

select = DSModelElementsSelection()  # 3099 picked in the model; graph input
R = IntegerSlider(194, range=0..255 step 1)  # graph input
G = IntegerSlider(41, range=0..255 step 1)  # graph input
B = IntegerSlider(169, range=0..255 step 1)  # graph input
否_還原_是_上色 = BoolSelector(true)  # graph input
python_script = Python(IN[0]=select, IN[1]=R, IN[2]=G, IN[3]=B, IN[4]=否_還原_是_上色)  # CPython3
# ---------- python_script.python (62 lines) ----------
import clr
clr.AddReference('RevitAPI')
clr.AddReference('RevitServices')

from Autodesk.Revit.DB import *
from RevitServices.Persistence import DocumentManager
from RevitServices.Transactions import TransactionManager

doc = DocumentManager.Instance.CurrentDBDocument
active_view = doc.ActiveView

# IN[0]：Select Model Elements
# IN[1]：R (0~255)
# IN[2]：G (0~255)
# IN[3]：B (0~255)
# IN[4]：Boolean Toggle — True=上色、False=還原原色
elements = IN[0] if isinstance(IN[0], list) else [IN[0]]
elements = [UnwrapElement(e) for e in elements]

apply_color = bool(IN[4])

TransactionManager.Instance.EnsureInTransaction(doc)

count = 0

if apply_color:
    # --- 上色 ---
    r, g, b = int(IN[1]), int(IN[2]), int(IN[3])
    single_color = Color(r, g, b)

    solid_fill_id = None
    for fp in FilteredElementCollector(doc).OfClass(FillPatternElement).ToElements():
        if fp.GetFillPattern().IsSolidFill:
            solid_fill_id = fp.Id
            break

    for elem in elements:
        try:
            ogs = OverrideGraphicSettings()
            ogs.SetProjectionLineColor(single_color)
            ogs.SetSurfaceForegroundPatternColor(single_color)
            ogs.SetSurfaceForegroundPatternVisible(True)
            if solid_fill_id:
                ogs.SetSurfaceForegroundPatternId(solid_fill_id)
            active_view.SetElementOverrides(elem.Id, ogs)
            count += 1
        except:
            pass
    msg = f"✅ 上色完成，{count} 個元素套用 RGB({r},{g},{b})"

else:
    # --- 還原（清除所有覆蓋）---
    for elem in elements:
        try:
            active_view.SetElementOverrides(elem.Id, OverrideGraphicSettings())
            count += 1
        except:
            pass
    msg = f"🔄 還原完成，{count} 個元素已清除覆蓋"

TransactionManager.Instance.TransactionTaskDone()
OUT = [msg]
# ----------------------------------------
