# Dynamo graph FT-CAD線型讀取轉換.dyn (Dynamo 2.19.3.6394)

點選CAD = DSModelElementSelection()  # 1 picked in the model; graph input
查尋圖層_ctrl_v = StringInput("FT-牆-剖線__RC牆-HATCH-1")  # graph input

# group: 線型選取
# 描述 <按兩下這裡以編輯群組描述>
專案所有線型 = Python()  # CPython3; graph output; unwired: IN[0]
# ---------- 專案所有線型.python (15 lines) ----------
import clr
clr.AddReference('RevitAPI')
from Autodesk.Revit.DB import *
clr.AddReference('RevitServices')
from RevitServices.Persistence import DocumentManager

doc = DocumentManager.Instance.CurrentDBDocument

lines_cat = doc.Settings.Categories.get_Item(BuiltInCategory.OST_Lines)

line_styles = sorted([
    sc.Name for sc in lines_cat.SubCategories
])

OUT = line_styles
# ----------------------------------------
對應下方線型選入_編號 = DoubleSlider(7, range=0..50 step 1)  # graph input
getItemAtIndex = List.GetItemAtIndex(list=專案所有線型, index=對應下方線型選入_編號)
否_3d線_是_2d線 = BoolSelector(true)  # graph input
對應下方線型輸入_編號 = DoubleInput(2)

python_script = Python(IN[0]=點選CAD, IN[1]=查尋圖層_ctrl_v, IN[2]=getItemAtIndex, IN[3]=否_3d線_是_2d線)  # CPython3
# ---------- python_script.python (148 lines) ----------
import clr
import System

clr.AddReference('RevitAPI')
from Autodesk.Revit.DB import *
clr.AddReference('RevitAPIUI')
from Autodesk.Revit.UI import *
clr.AddReference('RevitServices')
from RevitServices.Persistence import DocumentManager
from RevitServices.Transactions import TransactionManager

doc          = DocumentManager.Instance.CurrentDBDocument
uidoc        = DocumentManager.Instance.CurrentUIApplication.ActiveUIDocument
active_view  = doc.ActiveView
cad_instance = UnwrapElement(IN[0])

raw = IN[1]
target_layers = {raw.strip()} if isinstance(raw, str) \
                else {str(s).strip() for s in raw}
line_style_name = str(IN[2]).strip()

use_detail = True
if len(IN) > 3 and IN[3] is not None:
    use_detail = bool(IN[3])

existing_lines = []
if len(IN) > 4 and IN[4] is not None:
    raw4 = IN[4]
    existing_lines = raw4 if isinstance(raw4, list) else [raw4]

debug = []
debug.append("目標圖層：" + str(target_layers))
debug.append("線型模式：" + ("細部線" if use_detail else "模型線"))

all_styles   = FilteredElementCollector(doc).OfClass(GraphicsStyle)
target_style = next((s for s in all_styles if s.Name == line_style_name), None)
debug.append("目標線型：" + line_style_name + (" ✓" if target_style else " ✗ 找不到"))

sub_cats      = list(cad_instance.Category.SubCategories)
target_gs_ids = set()
for sc in sub_cats:
    if sc.Name in target_layers:
        gs = sc.GetGraphicsStyle(GraphicsStyleType.Projection)
        if gs:
            target_gs_ids.add(gs.Id)
            debug.append("圖層找到：" + sc.Name)

if not target_gs_ids:
    debug.append("⚠ 找不到目標圖層，請確認名稱正確")
    OUT = [[], debug]
else:
    filtered_curves = []

    opt = Options()
    opt.ComputeReferences        = True
    opt.IncludeNonVisibleObjects = True

    def collect(geom_list):
        for g in geom_list:
            if isinstance(g, GeometryInstance):
                collect(g.GetInstanceGeometry())
            elif isinstance(g, Curve):
                if g.GraphicsStyleId in target_gs_ids:
                    filtered_curves.append(('c', g))
            elif isinstance(g, PolyLine):
                if g.GraphicsStyleId in target_gs_ids:
                    filtered_curves.append(('p', g))

    collect(cad_instance.get_Geometry(opt))
    debug.append("收集曲線數：" + str(len(filtered_curves)))

    results       = []
    created_ids   = System.Collections.Generic.List[ElementId]()
    fail_count    = 0
    restyle_count = 0

    TransactionManager.Instance.EnsureInTransaction(doc)
    try:
        sketch_plane = None
        plane_z      = active_view.Origin.Z
        if not use_detail:
            plane        = Plane.CreateByNormalAndOrigin(XYZ.BasisZ, XYZ(0, 0, plane_z))
            sketch_plane = SketchPlane.Create(doc, plane)

        def project_to_z(curve, z):
            if isinstance(curve, Line):
                p0 = curve.GetEndPoint(0)
                p1 = curve.GetEndPoint(1)
                return Line.CreateBound(XYZ(p0.X, p0.Y, z), XYZ(p1.X, p1.Y, z))
            elif isinstance(curve, Arc):
                p0  = curve.GetEndPoint(0)
                p1  = curve.GetEndPoint(1)
                mid = curve.Evaluate(0.5, True)
                return Arc.Create(XYZ(p0.X, p0.Y, z), XYZ(p1.X, p1.Y, z), XYZ(mid.X, mid.Y, z))
            return curve

        def make_curve(curve):
            if use_detail:
                new_c = doc.Create.NewDetailCurve(active_view, curve)
            else:
                flat  = project_to_z(curve, plane_z)
                new_c = doc.Create.NewModelCurve(flat, sketch_plane)
            if target_style:
                new_c.LineStyle = target_style
            results.append(new_c)
            created_ids.Add(new_c.Id)

        for kind, g in filtered_curves:
            try:
                if kind == 'c':
                    make_curve(g)
                else:
                    pts = g.GetCoordinates()
                    for i in range(len(pts) - 1):
                        try:
                            make_curve(Line.CreateBound(pts[i], pts[i + 1]))
                        except Exception as seg_e:
                            fail_count += 1
                            if fail_count == 1:
                                debug.append("線段錯誤：" + str(seg_e)[:80])
            except Exception as curve_e:
                fail_count += 1
                if fail_count == 1:
                    debug.append("曲線錯誤：" + str(curve_e)[:80])

        if target_style and existing_lines:
            for item in existing_lines:
                try:
                    elem = UnwrapElement(item)
                    if elem:
                        elem.LineStyle = target_style
                        restyle_count += 1
                except:
                    pass
            debug.append("更改現有線型：" + str(restyle_count) + " 條")

        debug.append("✅ 新建：" + str(len(results)) + " 條  |  失敗：" + str(fail_count))
        TransactionManager.Instance.TransactionTaskDone()

    except Exception as e:
        TransactionManager.Instance.ForceCloseTransaction()
        debug.append("❌ 交易失敗：" + str(e))
        results = []

    if created_ids.Count > 0:
        uidoc.Selection.SetElementIds(created_ids)

    OUT = [results, debug]
# ----------------------------------------
置換線型_ctrl_v = StringInput("0-FT-VOID-開口(虛)")
