# Dynamo graph FT-匯出牆與RVT相同.dyn "FT-匯出牆與RVT相同#" (Dynamo 2.19.3.6394)

匯出存放路徑 = StringInput("D:\dynamo\匯出cad")  # graph input
python_script = Python(IN[0]=匯出存放路徑)  # CPython3
# ---------- python_script.python (78 lines) ----------
import clr, os, re
clr.AddReference('RevitAPI')
clr.AddReference('RevitServices')
from Autodesk.Revit.DB import *
from RevitServices.Persistence import DocumentManager
from RevitServices.Transactions import TransactionManager
from System.Collections.Generic import List

doc   = DocumentManager.Instance.CurrentDBDocument
uidoc = DocumentManager.Instance.CurrentUIApplication.ActiveUIDocument

export_folder = IN[0]
if not os.path.exists(export_folder):
    os.makedirs(export_folder)

source_view = uidoc.ActiveView
dup_opt = None
for opt in (ViewDuplicateOption.WithDetailing, ViewDuplicateOption.Duplicate):
    if source_view.CanViewBeDuplicated(opt):
        dup_opt = opt
        break

if dup_opt is None:
    OUT = [f"視圖「{source_view.Name}」無法複製"]
    raise Exception(OUT[0])

# 只收集當前視圖的牆（排除視圖專屬元素與群組內牆）
walls = [w for w in
    FilteredElementCollector(doc, source_view.Id)
    .OfClass(Wall).WhereElementIsNotElementType().ToElements()
    if not w.ViewSpecific and w.GroupId == ElementId.InvalidElementId]

if not walls:
    OUT = ["沒有牆元素"]
    raise Exception(OUT[0])

# 依牆類型名稱分組
type_map = {}
for w in walls:
    try: type_map.setdefault(w.Name, []).append(w.Id)
    except: pass

def clean_name(n):
    return re.sub(r'[\\/:*?"<>|]', '_', n)[:50]

results = []

for tname, keep_ids in type_map.items():
    # 建立暫時視圖，只顯示此牆類型
    TransactionManager.Instance.EnsureInTransaction(doc)
    tmp_vid  = source_view.Duplicate(dup_opt)
    tmp_view = doc.GetElement(tmp_vid)
    try:
        tmp_view.DisableTemporaryViewMode(TemporaryViewMode.TemporaryHideIsolate)
    except:
        pass
    # 隔離目標牆 → 轉為永久隱藏（其餘全部隱藏）
    tmp_view.IsolateElementsTemporary(List[ElementId](keep_ids))
    tmp_view.ConvertTemporaryHideIsolateToPermanent()
    TransactionManager.Instance.TransactionTaskDone()

    # 匯出 DXF（Transaction 外執行）
    opts = DXFExportOptions()
    opts.FileVersion = ACADVersion.R2013
    safe = clean_name(tname)
    try:
        ok = doc.Export(export_folder, safe, List[ElementId]([tmp_vid]), opts)
        results.append(f"{'OK' if ok else 'FAIL'}: {safe}.dxf")
    except Exception as e:
        results.append(f"FAIL: {tname} → {str(e)[:80]}")

    # 刪除暫時視圖
    TransactionManager.Instance.EnsureInTransaction(doc)
    try: doc.Delete(tmp_vid)
    except: pass
    TransactionManager.Instance.TransactionTaskDone()

OUT = [f"視圖：{source_view.Name}，共 {len(type_map)} 種", results]
# ----------------------------------------
