# Dynamo graph FT- 標註[柱]平面.dyn (Dynamo 2.19.3.6394)
# author: CHIUNG YING
# ✨操作說明：需輸入相關資訊

框選_網格_柱 = DSModelElementsSelection()  # 124 picked in the model; graph input
n2_標註類型_預設 = StringInput("FT-DIM-COL(TXT_4.0mm)")  # "2.標註類型(預設)"
標註間距_外層_總寬總高 = DoubleSlider(700, range=300..1000 step 100)  # graph input
標註間距_內層_柱與網格 = DoubleSlider(300, range=0..1000 step 100)  # graph input
code_block = CodeBlock { 1; }
x向_柱標註位置_否_是 = BoolSelector(true)  # graph input
y向_柱標註位置_否_是 = BoolSelector(true)  # graph input
python_script = Python(IN[0]=框選_網格_柱, IN[1]=n2_標註類型_預設, IN[2]=標註間距_外層_總寬總高, IN[3]=標註間距_內層_柱與網格, IN[4]=code_block, IN[5]=x向_柱標註位置_否_是, IN[6]=y向_柱標註位置_否_是)  # CPython3
# ---------- python_script.python (181 lines) ----------
import math
from Autodesk.Revit.DB import FilteredElementCollector, DimensionType
from Autodesk.Revit.DB import Options, ViewDetailLevel, GeometryInstance, Solid
from Autodesk.Revit.DB import PlanarFace, Line, XYZ, ReferenceArray, Reference
from Autodesk.Revit.DB import BuiltInCategory, BuiltInParameter
from Autodesk.Revit.DB import UnitUtils, UnitTypeId
from RevitServices.Persistence import DocumentManager
from RevitServices.Transactions import TransactionManager


doc = DocumentManager.Instance.CurrentDBDocument
view = doc.ActiveView

# --- 1. 取得輸入參數 ---
raw_elems = IN[0] if isinstance(IN[0], list) else [IN[0]]
dim_type_name = IN[1]
dist_far = float(IN[2]) if IN[2] is not None else 1000.0   # 外層 (70-305)
dist_near = float(IN[3]) if IN[3] is not None else 600.0   # 內層 (35/35)

# --- 2. 方向控制 (Boolean 切換) ---
# True = 正向 (1), False = 負向 (-1)
SIDE_X = 1 if IN[5] is True else -1
SIDE_Y = 1 if IN[6] is True else -1

def ft(mm):
    return UnitUtils.ConvertToInternalUnits(mm, UnitTypeId.Millimeters)

D_NEAR = ft(dist_near) 
D_FAR = ft(dist_far)   

def unwrap(x):
    return x.InternalElement if hasattr(x, 'InternalElement') else x

# 獲取標註類型
all_dt = list(FilteredElementCollector(doc).OfClass(DimensionType).ToElements())
dim_type = next((dt for dt in all_dt if dt.get_Parameter(BuiltInParameter.ALL_MODEL_TYPE_NAME).AsString() == dim_type_name), None)
if dim_type is None and all_dt: dim_type = all_dt[0]

# 分類元件
cols = []; grids_x = []; grids_y = []
for raw in raw_elems:
    elem = unwrap(raw)
    if elem is None: continue
    cat_id = elem.Category.Id.IntegerValue
    if cat_id in [int(BuiltInCategory.OST_StructuralColumns), int(BuiltInCategory.OST_Columns)]:
        cols.append(elem)
    elif cat_id == int(BuiltInCategory.OST_Grids):
        c = elem.Curve
        if isinstance(c, Line):
            gd = c.Direction.Normalize()
            if abs(gd.Y) > 0.7: grids_x.append(elem) # 垂直網格
            elif abs(gd.X) > 0.7: grids_y.append(elem) # 水平網格

# --- 強化搜尋函數：找尋最近的網格 ---
def get_nearest_grid_ref(target_pos, grids, axis):
    nearest_ref = None
    min_dist = ft(300) # 30cm 搜尋半徑
    for g in grids:
        g_pos = g.Curve.GetEndPoint(0).X if axis == 'X' else g.Curve.GetEndPoint(0).Y
        dist = abs(g_pos - target_pos)
        if dist < min_dist:
            min_dist = dist
            nearest_ref = Reference(g)
    return nearest_ref

def get_face_refs(col_elem, normal_dir):
    opts = Options(); opts.ComputeReferences = True; opts.DetailLevel = ViewDetailLevel.Fine
    faces = []
    try:
        geo = col_elem.get_Geometry(opts)
        for g_obj in geo:
            parts = list(g_obj.GetInstanceGeometry()) if isinstance(g_obj, GeometryInstance) else [g_obj]
            for part in parts:
                if isinstance(part, Solid) and part.Volume > 0:
                    for face in part.Faces:
                        if isinstance(face, PlanarFace):
                            dot = face.FaceNormal.Normalize().DotProduct(normal_dir)
                            if abs(dot) > 0.99: faces.append((face.Reference, face.Origin.DotProduct(normal_dir)))
    except: pass
    faces.sort(key=lambda x: x[1])
    return faces 

def group_elements(elements, axis, tol=ft(200)):
    groups = []
    for e in elements:
        bbox = e.get_BoundingBox(view)
        pos = (bbox.Min.Y + bbox.Max.Y)/2 if axis == 'X' else (bbox.Min.X + bbox.Max.X)/2
        found = False
        for g in groups:
            if abs(g['pos'] - pos) < tol:
                g['items'].append(e); found = True; break
        if not found: groups.append({'pos': pos, 'items': [e]})
    return groups

TransactionManager.Instance.EnsureInTransaction(doc)

# --- X 方向邏輯 ---
for group in group_elements(cols, 'X'):
    items = group['items']
    ref_layer_far = [] 
    base_y = max(i.get_BoundingBox(view).Max.Y for i in items) if SIDE_X == 1 else min(i.get_BoundingBox(view).Min.Y for i in items)

    for col in items:
        bbox = col.get_BoundingBox(view); f_refs = get_face_refs(col, XYZ.BasisX)
        if len(f_refs) < 2: continue
        
        mid_x = (bbox.Min.X + bbox.Max.X) / 2
        col_grid_ref = get_nearest_grid_ref(mid_x, grids_x, 'X')

        final_ref_near = ReferenceArray()
        final_ref_near.Append(f_refs[0][0])
        if col_grid_ref: final_ref_near.Append(col_grid_ref)
        final_ref_near.Append(f_refs[-1][0])
        
        y_loc_near = base_y + (SIDE_X * D_NEAR)
        ln_near = Line.CreateBound(XYZ(bbox.Min.X, y_loc_near, 0), XYZ(bbox.Max.X, y_loc_near, 0))
        try:
            dn = doc.Create.NewDimension(view, ln_near, final_ref_near)
            if dim_type: dn.DimensionType = dim_type
        except: pass
            
        ref_layer_far.append((f_refs[0][0], f_refs[0][1]))
        ref_layer_far.append((f_refs[-1][0], f_refs[-1][1]))
    
    ref_layer_far.sort(key=lambda x: x[1])
    final_ref_far = ReferenceArray(); lp = None
    for r, p in ref_layer_far:
        if lp is None or abs(p - lp) > ft(5): final_ref_far.Append(r); lp = p
    
    y_loc_far = base_y + (SIDE_X * D_FAR)
    ln_far = Line.CreateBound(XYZ(min(i.get_BoundingBox(view).Min.X for i in items), y_loc_far, 0), 
                               XYZ(max(i.get_BoundingBox(view).Max.X for i in items), y_loc_far, 0))
    try:
        df = doc.Create.NewDimension(view, ln_far, final_ref_far)
        if dim_type: df.DimensionType = dim_type
    except: pass

# --- Y 方向邏輯 (垂直) ---
for group in group_elements(cols, 'Y'):
    items = group['items']
    ref_layer_far_y = []
    base_x = max(i.get_BoundingBox(view).Max.X for i in items) if SIDE_Y == 1 else min(i.get_BoundingBox(view).Min.X for i in items)

    for col in items:
        bbox = col.get_BoundingBox(view); f_refs = get_face_refs(col, XYZ.BasisY)
        if len(f_refs) < 2: continue

        mid_y = (bbox.Min.Y + bbox.Max.Y) / 2
        col_grid_ref_y = get_nearest_grid_ref(mid_y, grids_y, 'Y')

        final_ref_near_y = ReferenceArray()
        final_ref_near_y.Append(f_refs[0][0])
        if col_grid_ref_y: final_ref_near_y.Append(col_grid_ref_y)
        final_ref_near_y.Append(f_refs[-1][0])
        
        x_loc_near = base_x + (SIDE_Y * D_NEAR)
        ln_near_y = Line.CreateBound(XYZ(x_loc_near, bbox.Min.Y, 0), XYZ(x_loc_near, bbox.Max.Y, 0))
        try:
            dn_y = doc.Create.NewDimension(view, ln_near_y, final_ref_near_y)
            if dim_type: dn_y.DimensionType = dim_type
        except: pass

        ref_layer_far_y.append((f_refs[0][0], f_refs[0][1]))
        ref_layer_far_y.append((f_refs[-1][0], f_refs[-1][1]))
    
    ref_layer_far_y.sort(key=lambda x: x[1])
    final_ref_far_y = ReferenceArray(); lp = None
    for r, p in ref_layer_far_y:
        if lp is None or abs(p - lp) > ft(5): final_ref_far_y.Append(r); lp = p
            
    x_loc_far = base_x + (SIDE_Y * D_FAR)
    ln_far_y = Line.CreateBound(XYZ(x_loc_far, min(i.get_BoundingBox(view).Min.Y for i in items), 0), 
                                 XYZ(x_loc_far, max(i.get_BoundingBox(view).Max.Y for i in items), 0))
    try:
        df_y = doc.Create.NewDimension(view, ln_far_y, final_ref_far_y)
        if dim_type: df_y.DimensionType = dim_type
    except: pass

TransactionManager.Instance.TransactionTaskDone()

OUT = "成功：已更新為 Boolean 方向控制"
# ----------------------------------------
watch = Watch(python_script)
x向方向_1_1 = IntegerSlider(1, range=-1..1 step 2)
y向_柱標註位置_否_是_2 = IntegerSlider(1, range=-1..1 step 2)
