# Dynamo graph FT- 標註[樑]平面.dyn (Dynamo 2.19.3.6394)
# author: CHIUNG YING
# ✨操作說明：需輸入相關資訊

框選_網格_樑 = DSModelElementsSelection()  # 115 picked in the model; graph input
標註類型_key_in = StringInput("FT-DIM-BEAM(TXT_4.0mm)")  # graph input
標註間距_外層_總寬 = DoubleSlider(600, range=0..1000 step 50)  # graph input
標註間距_內層_樑與網格 = DoubleSlider(100, range=0..1000 step 50)  # graph input
最短樑長度_過濾柱邊短樑 = DoubleSlider(600, range=0..1000 step 50)
y向_總尺寸位置_否_是 = BoolSelector(true)  # graph input
x向_總尺寸位置_否_是 = BoolSelector(true)  # graph input
python_script = Python(IN[0]=框選_網格_樑, IN[1]=標註類型_key_in, IN[2]=標註間距_外層_總寬, IN[3]=標註間距_內層_樑與網格, IN[4]=最短樑長度_過濾柱邊短樑, IN[5]=y向_總尺寸位置_否_是, IN[6]=x向_總尺寸位置_否_是)  # CPython3
# ---------- python_script.python (301 lines) ----------
import clr
clr.AddReference('RevitAPI')
clr.AddReference('RevitServices')

from Autodesk.Revit.DB import Grid as RevitGrid
from Autodesk.Revit.DB import (
    FilteredElementCollector, DimensionType, Options,
    GeometryInstance, Solid, PlanarFace, Line, XYZ,
    ReferenceArray, Reference, BuiltInCategory, BuiltInParameter,
    UnitUtils, UnitTypeId
)

from RevitServices.Persistence import DocumentManager
from RevitServices.Transactions import TransactionManager

doc  = DocumentManager.Instance.CurrentDBDocument
view = doc.ActiveView

# ─── 輸入 ───────────────────────────────────────────────────────────────────────
raw     = IN[0] if isinstance(IN[0], list) else [IN[0]]
dname   = IN[1]
D_FAR   = UnitUtils.ConvertToInternalUnits(float(IN[2] or 400), UnitTypeId.Millimeters)
D_NEAR  = UnitUtils.ConvertToInternalUnits(float(IN[3] or 50),  UnitTypeId.Millimeters)
MIN_LEN = UnitUtils.ConvertToInternalUnits(float(IN[4] or 500), UnitTypeId.Millimeters)
SX = 1.0 if IN[5] else -1.0
SY = 1.0 if IN[6] else -1.0
PAD = UnitUtils.ConvertToInternalUnits(30.0, UnitTypeId.Millimeters)

def mm(v):
    return UnitUtils.ConvertToInternalUnits(v, UnitTypeId.Millimeters)

def uw(x):
    return x.InternalElement if hasattr(x, 'InternalElement') else x

# ─── 標註類型（雙重備援） ────────────────────────────────────────────────────────
dim_type = None
for dt in FilteredElementCollector(doc).OfClass(DimensionType).WhereElementIsElementType():
    try:
        if dt.Name == dname:
            dim_type = dt
            break
    except:
        continue
if dim_type is None:
    for dt in FilteredElementCollector(doc).OfClass(DimensionType).WhereElementIsElementType():
        try:
            p = dt.get_Parameter(BuiltInParameter.ALL_MODEL_TYPE_NAME)
            if p is not None and p.AsString() == dname:
                dim_type = dt
                break
        except:
            continue
if dim_type is None:
    OUT = [[], ["找不到標註類型: " + str(dname)]]
    raise Exception("DimensionType not found: " + str(dname))

# ─── 分類元素 ─────────────────────────────────────────────────────────────────
beams_x, beams_y = [], []
grids_h, grids_v = [], []

for item in raw:
    e = uw(item)
    if e is None:
        continue

    # ✅ Grid 用 isinstance + e.Curve 直接讀取（不用 Location.Curve）
    if isinstance(e, RevitGrid):
        try:
            c  = e.Curve          # Grid 專屬屬性，比 Location.Curve 可靠
            p0 = c.GetEndPoint(0)
            p1 = c.GetEndPoint(1)
            if abs(p1.X - p0.X) > abs(p1.Y - p0.Y):
                grids_h.append(e)
            else:
                grids_v.append(e)
        except:
            pass
        continue

    # 結構框架（樑）
    cat = e.Category
    if cat is None:
        continue
    if cat.Id.IntegerValue != int(BuiltInCategory.OST_StructuralFraming):
        continue
    loc = e.Location
    if not hasattr(loc, 'Curve'):
        continue
    c = loc.Curve
    if c.Length < MIN_LEN:
        continue
    p0 = c.GetEndPoint(0)
    p1 = c.GetEndPoint(1)
    if abs(p1.X - p0.X) > abs(p1.Y - p0.Y):
        beams_x.append(e)
    else:
        beams_y.append(e)

# ─── 取得截面兩側面參考 ──────────────────────────────────────────────────────────
def get_face_refs(beam, use_y):
    opt = Options()
    opt.ComputeReferences        = True
    opt.IncludeNonVisibleObjects = False
    opt.View = view

    candidates = []
    for g in beam.get_Geometry(opt):
        solids = []
        if isinstance(g, GeometryInstance):
            try:
                for sg in g.GetInstanceGeometry():
                    if isinstance(sg, Solid) and sg.Volume > 1e-9:
                        solids.append(sg)
            except:
                pass
        elif isinstance(g, Solid) and g.Volume > 1e-9:
            solids.append(g)

        for solid in solids:
            for face in solid.Faces:
                if not isinstance(face, PlanarFace):
                    continue
                fn  = face.FaceNormal
                dot = abs(fn.Y) if use_y else abs(fn.X)
                if dot < 0.9:
                    continue
                try:
                    ref = face.Reference
                except:
                    continue
                if ref is None:
                    continue
                pos = face.Origin.Y if use_y else face.Origin.X
                candidates.append((pos, ref))

    if len(candidates) < 2:
        return []
    candidates.sort(key=lambda x: x[0])
    return [candidates[0], candidates[-1]]

# ─── 找距樑中心最近的柱線（不依賴截面範圍） ─────────────────────────────────────
def find_nearest_grid(grids, use_y, center_pos):
    best   = None
    best_d = float('inf')
    for g in grids:
        try:
            c = g.Curve           # ✅ Grid.Curve 直接屬性
        except:
            try:
                c = g.Location.Curve
            except:
                continue
        p0  = c.GetEndPoint(0)
        p1  = c.GetEndPoint(1)
        pos = (p0.Y + p1.Y) / 2.0 if use_y else (p0.X + p1.X) / 2.0
        d   = abs(pos - center_pos)
        if d < best_d:
            best_d = d
            best   = (pos, Reference(g))
    return [best] if best is not None else []

# ─── 建立標註（過濾 0 段） ────────────────────────────────────────────────────────
def make_dim(refs_list, line):
    if len(refs_list) < 2:
        return None
    # 過濾相鄰位置太近的參考（防止 0 尺寸）
    min_seg = mm(1)
    filtered = [refs_list[0]]
    for item in refs_list[1:]:
        if abs(item[0] - filtered[-1][0]) >= min_seg:
            filtered.append(item)
    if len(filtered) < 2:
        return None
    ra = ReferenceArray()
    for _, ref in filtered:
        ra.Append(ref)
    try:
        return doc.Create.NewDimension(view, line, ra, dim_type)
    except Exception as ex:
        return "ERR:" + str(ex)

# ─── 跨度重疊分組 ────────────────────────────────────────────────────────────────
def group_by_span_overlap(beams, get_lo_hi_cx):
    info  = [(b,) + get_lo_hi_cx(b) for b in beams]
    used  = [False] * len(info)
    groups = []
    for i, (b, lo, hi, cx) in enumerate(info):
        if used[i]:
            continue
        grp = [info[i]]
        used[i] = True
        for j, (b2, lo2, hi2, cx2) in enumerate(info):
            if used[j]:
                continue
            if lo2 < hi and lo < hi2:
                grp.append(info[j])
                used[j] = True
        groups.append(grp)
    return groups

def x_lo_hi_cx(b):
    c  = b.Location.Curve
    x0 = c.GetEndPoint(0).X
    x1 = c.GetEndPoint(1).X
    return (min(x0,x1), max(x0,x1), (x0+x1)/2.0)

def y_lo_hi_cy(b):
    c  = b.Location.Curve
    y0 = c.GetEndPoint(0).Y
    y1 = c.GetEndPoint(1).Y
    return (min(y0,y1), max(y0,y1), (y0+y1)/2.0)

# ─── 主程式 ───────────────────────────────────────────────────────────────────────
results, errors = [], []
TransactionManager.Instance.EnsureInTransaction(doc)

# ══ X向樑：BasisY面 + 水平柱線 → 垂直標註線 ══════════════════════════════════════
for beam in beams_x:
    c  = beam.Location.Curve
    cx = (c.GetEndPoint(0).X + c.GetEndPoint(1).X) / 2.0

    fr = get_face_refs(beam, use_y=True)
    if len(fr) < 2:
        errors.append("X-beam %d: no Y-faces" % beam.Id.IntegerValue)
        continue

    y_lo = fr[0][0]
    y_hi = fr[-1][0]
    cy_beam = (y_lo + y_hi) / 2.0
    g_in = find_nearest_grid(grids_h, use_y=True,  center_pos=cy_beam)

    x_line = cx + SX * D_NEAR
    line   = Line.CreateBound(XYZ(x_line, y_lo - PAD, 0.0),
                              XYZ(x_line, y_hi + PAD, 0.0))
    d = make_dim([fr[0]] + g_in + [fr[-1]], line)
    (results if d and not isinstance(d, str) else errors).append(d)

for grp in group_by_span_overlap(beams_x, x_lo_hi_cx):
    if len(grp) < 2:
        continue
    all_faces, cx_list = [], []
    for (b, lo, hi, cx) in grp:
        fr = get_face_refs(b, use_y=True)
        if len(fr) >= 2:
            all_faces.extend(fr)
        cx_list.append(cx)
    if len(all_faces) < 4:
        continue
    all_faces.sort(key=lambda x: x[0])
    gcx   = sum(cx_list) / len(cx_list)
    x_out = gcx + SX * D_FAR
    line  = Line.CreateBound(XYZ(x_out, all_faces[0][0] - PAD, 0.0),
                             XYZ(x_out, all_faces[-1][0] + PAD, 0.0))
    d = make_dim(all_faces, line)
    (results if d and not isinstance(d, str) else errors).append(d)

# ══ Y向樑：BasisX面 + 垂直柱線 → 水平標註線 ══════════════════════════════════════
for beam in beams_y:
    c  = beam.Location.Curve
    cy = (c.GetEndPoint(0).Y + c.GetEndPoint(1).Y) / 2.0

    fr = get_face_refs(beam, use_y=False)
    if len(fr) < 2:
        errors.append("Y-beam %d: no X-faces" % beam.Id.IntegerValue)
        continue

    x_lo = fr[0][0]
    x_hi = fr[-1][0]
    cx_beam = (x_lo + x_hi) / 2.0
    g_in = find_nearest_grid(grids_v, use_y=False, center_pos=cx_beam)

    y_line = cy + SY * D_NEAR
    line   = Line.CreateBound(XYZ(x_lo - PAD, y_line, 0.0),
                              XYZ(x_hi + PAD, y_line, 0.0))
    d = make_dim([fr[0]] + g_in + [fr[-1]], line)
    (results if d and not isinstance(d, str) else errors).append(d)

for grp in group_by_span_overlap(beams_y, y_lo_hi_cy):
    if len(grp) < 2:
        continue
    all_faces, cy_list = [], []
    for (b, lo, hi, cy) in grp:
        fr = get_face_refs(b, use_y=False)
        if len(fr) >= 2:
            all_faces.extend(fr)
        cy_list.append(cy)
    if len(all_faces) < 4:
        continue
    all_faces.sort(key=lambda x: x[0])
    gcy   = sum(cy_list) / len(cy_list)
    y_out = gcy + SY * D_FAR
    line  = Line.CreateBound(XYZ(all_faces[0][0] - PAD, y_out, 0.0),
                             XYZ(all_faces[-1][0] + PAD, y_out, 0.0))
    d = make_dim(all_faces, line)
    (results if d and not isinstance(d, str) else errors).append(d)

errors.append("grids_h=%d  grids_v=%d  beams_x=%d  beams_y=%d"
              % (len(grids_h), len(grids_v), len(beams_x), len(beams_y)))

TransactionManager.Instance.TransactionTaskDone()
OUT = [results, errors]
# ----------------------------------------
watch = Watch(python_script)
