# Dynamo graph FT- 標註[牆]平面.dyn (Dynamo 2.19.3.6394)
# author: CHIUNG YING
# ✨操作說明：需輸入相關資訊

標註類型_key_in = StringInput("FT-DIM-WALL(TXT_4.0mm)")
間距_外層_總寬總高_預設 = DoubleSlider(1000, range=300..1000 step 100)
框選_網格_牆 = DSModelElementsSelection()  # 18 picked in the model; graph input
標註與牆的間距_預設 = DoubleSlider(300, range=0..1000 step 100)  # graph input
code_block = CodeBlock { 1; }
x向_牆標註位置_否_是 = BoolSelector(true)  # graph input
y向_牆標註位置_否_是 = BoolSelector(true)  # graph input
python_script = Python(IN[0]=框選_網格_牆, IN[3]=標註與牆的間距_預設, IN[4]=code_block, IN[5]=x向_牆標註位置_否_是, IN[6]=y向_牆標註位置_否_是)  # CPython3; unwired: IN[1], IN[2]
# ---------- python_script.python (305 lines) ----------
import math
from Autodesk.Revit.DB import FilteredElementCollector, DimensionType, Dimension
from Autodesk.Revit.DB import Options, ViewDetailLevel, GeometryInstance, Solid
from Autodesk.Revit.DB import PlanarFace, Line, XYZ, ReferenceArray, Reference
from Autodesk.Revit.DB import BuiltInCategory, BuiltInParameter, LocationCurve
from Autodesk.Revit.DB import UnitUtils, UnitTypeId
from RevitServices.Persistence import DocumentManager
from RevitServices.Transactions import TransactionManager

doc = DocumentManager.Instance.CurrentDBDocument
view = doc.ActiveView

# --- 1. 參數 ---
raw_elems     = IN[0] if isinstance(IN[0], list) else [IN[0]]
wall_dim_name = "FT-DIM-WALL(TXT_4.0mm)"
void_dim_name = "FT-DIM-VOID(TXT_4.0mm)"
dist_near     = float(IN[3]) if IN[3] is not None else 600.0
SIDE_X        = 1 if IN[5] is True else -1
SIDE_Y        = 1 if IN[6] is True else -1

def ft(mm):
    return UnitUtils.ConvertToInternalUnits(mm, UnitTypeId.Millimeters)

D_NEAR        = ft(dist_near)
MIN_SPAN      = ft(50)
CORNER_TOL    = ft(100)
DOOR_WIN_CATS = {int(BuiltInCategory.OST_Doors), int(BuiltInCategory.OST_Windows)}

def unwrap(x):
    return x.InternalElement if hasattr(x, 'InternalElement') else x

def safe_type_name(elem):
    try:
        t = doc.GetElement(elem.GetTypeId())
        if t and t.Name: return t.Name
    except: pass
    try:
        n = elem.Name
        if n: return n
    except: pass
    return ""

# --- 2. 標註型式 ---
all_dt = list(FilteredElementCollector(doc).OfClass(DimensionType).ToElements())
def find_dt(name):
    dt = next((d for d in all_dt
               if d.get_Parameter(BuiltInParameter.ALL_MODEL_TYPE_NAME).AsString() == name), None)
    return dt or (all_dt[0] if all_dt else None)
dt_wall = find_dt(wall_dim_name)
dt_void = find_dt(void_dim_name)

# --- 3. 分類 ---
h_walls = []; v_walls = []
for raw in raw_elems:
    elem = unwrap(raw)
    if elem is None: continue
    try: cat_id = elem.Category.Id.IntegerValue
    except: continue
    if cat_id != int(BuiltInCategory.OST_Walls): continue
    if "RC" not in safe_type_name(elem): continue
    try:
        lc = elem.Location
        if isinstance(lc, LocationCurve):
            p1 = lc.Curve.GetEndPoint(1); p0 = lc.Curve.GetEndPoint(0)
            if abs(p1.X - p0.X) >= abs(p1.Y - p0.Y): h_walls.append(elem)
            else: v_walls.append(elem)
        else: h_walls.append(elem)
    except: h_walls.append(elem)

# --- 4. 輔助函式 ---
def collect_solid_faces(geo_iter, normal_dir, out, dot_tol=0.99):
    for g_obj in geo_iter:
        parts = [g_obj]
        if isinstance(g_obj, GeometryInstance):
            try: parts = list(g_obj.GetInstanceGeometry())
            except: continue
        for part in parts:
            if isinstance(part, Solid) and part.Volume > 0:
                for face in part.Faces:
                    if isinstance(face, PlanarFace):
                        dot = face.FaceNormal.Normalize().DotProduct(normal_dir)
                        if abs(dot) > dot_tol:
                            out.append((face.Reference, face.Origin.DotProduct(normal_dir)))

def get_all_faces_sorted(elem, normal_dir, tol_mm=10, dot_tol=0.99):
    opts = Options(); opts.ComputeReferences = True; opts.DetailLevel = ViewDetailLevel.Fine
    faces = []
    try:
        geo = elem.get_Geometry(opts)
        if geo: collect_solid_faces(geo, normal_dir, faces, dot_tol)
    except: pass
    faces.sort(key=lambda x: x[1])
    tol = ft(tol_mm); deduped = []
    for f in faces:
        if not deduped or abs(f[1] - deduped[-1][1]) > tol: deduped.append(f)
    return deduped

def get_outer_two(faces):
    return [faces[0], faces[-1]] if len(faces) >= 2 else faces

def find_face_near(faces, target, tol_mm=60):
    tol = ft(tol_mm); best = None; best_d = tol
    for ref, pos in faces:
        d = abs(pos - target)
        if d < best_d: best_d = d; best = ref
    return best

def group_elements(elements, axis, tol=ft(500)):
    groups = []
    for e in elements:
        try: bbox = e.get_BoundingBox(view)
        except: continue
        if not bbox: continue
        pos = (bbox.Min.Y + bbox.Max.Y)/2 if axis=='X' else (bbox.Min.X + bbox.Max.X)/2
        found = False
        for g in groups:
            if abs(g['pos'] - pos) < tol: g['items'].append(e); found = True; break
        if not found: groups.append({'pos': pos, 'items': [e]})
    return groups

def try_dim(p0, p1, ra, dt):
    if ra.Size < 2: return False
    if p0.DistanceTo(p1) < ft(1): return False
    try:
        d = doc.Create.NewDimension(view, Line.CreateBound(p0, p1), ra)
        if d and dt: d.DimensionType = dt
        return True
    except: return False

def get_wall_actual_perp(wall, is_x):
    """取得牆的實際垂直方向（處理略微旋轉的牆）"""
    try:
        lc = wall.Location
        if isinstance(lc, LocationCurve):
            p0 = lc.Curve.GetEndPoint(0); p1 = lc.Curve.GetEndPoint(1)
            dx = p1.X - p0.X; dy = p1.Y - p0.Y
            ln = math.sqrt(dx*dx + dy*dy)
            if ln > 1e-6:
                return XYZ(-dy/ln, dx/ln, 0)
    except: pass
    return XYZ.BasisY if is_x else XYZ.BasisX

# --- 5. 執行 ---
TransactionManager.Instance.EnsureInTransaction(doc)

# 清除舊標註
clear_ids = set()
if dt_wall: clear_ids.add(dt_wall.Id.IntegerValue)
if dt_void: clear_ids.add(dt_void.Id.IntegerValue)
for d in list(FilteredElementCollector(doc, view.Id).OfClass(Dimension).ToElements()):
    try:
        if d.DimensionType.Id.IntegerValue in clear_ids: doc.Delete(d.Id)
    except: pass

def wall_span(wall, normal_dir, dot_tol=0.99):
    faces = get_all_faces_sorted(wall, normal_dir, dot_tol=dot_tol)
    outer = get_outer_two(faces)
    if len(outer) < 2: return None
    lo, hi = outer[0][1], outer[-1][1]
    if (hi - lo) < MIN_SPAN: return None
    return lo, hi, outer[0][0], outer[-1][0]

h_spans = {}; v_spans = {}
for w in h_walls:
    s = wall_span(w, XYZ.BasisX)
    if s: h_spans[w] = s
for w in v_walls:
    s = wall_span(w, XYZ.BasisY)
    if s: v_spans[w] = s

def run_group(walls_list, normal_dir, is_x):
    side       = SIDE_X if is_x else SIDE_Y
    group_axis = 'X' if is_x else 'Y'
    perp_dir   = XYZ.BasisY if is_x else XYZ.BasisX
    spans_dict = h_spans if is_x else v_spans
    adj_walls  = v_walls if is_x else h_walls
    adj_dir    = XYZ.BasisY if is_x else XYZ.BasisX

    for group in group_elements(walls_list, group_axis):
        items  = group['items']
        bboxes = [i.get_BoundingBox(view) for i in items]
        bboxes = [b for b in bboxes if b]
        if not bboxes: continue

        base = (max(b.Max.Y for b in bboxes) if (is_x and side==1) else
                min(b.Min.Y for b in bboxes) if is_x else
                max(b.Max.X for b in bboxes) if side==1 else
                min(b.Min.X for b in bboxes))
        near_coord = base + side * D_NEAR

        for item in items:
            sp = spans_dict.get(item)
            if not sp: continue
            lo, hi, lo_r, hi_r = sp

            # ── A. 牆長+開口連續標（直接用牆幾何所有法向面，含開口夾面）──
            # 修正1：用 all_dir_faces 取代手動拼接 bbox，避免 "0" 及遺漏小段
            all_dir_faces = get_all_faces_sorted(item, normal_dir)

            # 只保留牆跨度範圍內的面（lo±5mm ~ hi±5mm）
            span_faces = [(ref, pos) for ref, pos in all_dir_faces
                          if lo - ft(5) <= pos <= hi + ft(5)]

            # 確保兩端面存在
            if not span_faces:
                span_faces = [(lo_r, lo), (hi_r, hi)]
            else:
                if abs(span_faces[0][1] - lo) > ft(5):
                    span_faces.insert(0, (lo_r, lo))
                if abs(span_faces[-1][1] - hi) > ft(5):
                    span_faces.append((hi_r, hi))

            # 去重：確保相鄰位置差 > ft(5)，消除潛在 "0" 段
            deduped = [span_faces[0]]
            for ref, pos in span_faces[1:]:
                if abs(pos - deduped[-1][1]) > ft(5):
                    deduped.append((ref, pos))

            if len(deduped) >= 2:
                ra = ReferenceArray()
                for ref, _ in deduped: ra.Append(ref)
                p0 = XYZ(deduped[0][1],  near_coord, 0) if is_x else XYZ(near_coord, deduped[0][1],  0)
                p1 = XYZ(deduped[-1][1], near_coord, 0) if is_x else XYZ(near_coord, deduped[-1][1], 0)
                try_dim(p0, p1, ra, dt_wall)

            # ── B. 開口 VOID 標 ──
            try:
                for ins_id in item.FindInserts(False, False, False, False):
                    ins = doc.GetElement(ins_id)
                    if ins is None: continue
                    try: ins_cat = ins.Category.Id.IntegerValue
                    except: continue
                    if ins_cat not in DOOR_WIN_CATS: continue
                    try:
                        ins_bbox = ins.get_BoundingBox(view) or ins.get_BoundingBox(None)
                        if not ins_bbox: continue
                        i_lo = ins_bbox.Min.X if is_x else ins_bbox.Min.Y
                        i_hi = ins_bbox.Max.X if is_x else ins_bbox.Max.Y
                        if (i_hi - i_lo) < MIN_SPAN: continue
                        r_lo = find_face_near(all_dir_faces, i_lo)
                        r_hi = find_face_near(all_dir_faces, i_hi)
                        if not r_lo or not r_hi: continue
                        ra_v = ReferenceArray(); ra_v.Append(r_lo); ra_v.Append(r_hi)
                        vp0 = XYZ(i_lo, near_coord, 0) if is_x else XYZ(near_coord, i_lo, 0)
                        vp1 = XYZ(i_hi, near_coord, 0) if is_x else XYZ(near_coord, i_hi, 0)
                        try_dim(vp0, vp1, ra_v, dt_void)
                    except: continue
            except: pass

            # ── C. 牆厚（修正2：用實際法向 + dot_tol=0.95，處理 145 牆遺漏）──
            actual_perp = get_wall_actual_perp(item, is_x)
            th_faces_all = get_all_faces_sorted(item, actual_perp, tol_mm=5, dot_tol=0.95)
            th_faces = get_outer_two(th_faces_all)
            if len(th_faces) < 2: continue
            t0, t1 = th_faces[0][1], th_faces[-1][1]
            if (t1 - t0) < ft(1): continue

            # ── D. 牆厚 + 鄰接垂直牆長連續（角落拼接）──
            for end_pos in [lo, hi]:
                for adj in adj_walls:
                    adj_bbox = adj.get_BoundingBox(view)
                    if not adj_bbox: continue
                    if is_x:
                        adj_range = (adj_bbox.Min.X, adj_bbox.Max.X)
                        my_perp_range = (t0, t1)
                    else:
                        adj_range = (adj_bbox.Min.Y, adj_bbox.Max.Y)
                        my_perp_range = (t0, t1)
                    if adj_range[1] < my_perp_range[0] - CORNER_TOL: continue
                    if adj_range[0] > my_perp_range[1] + CORNER_TOL: continue

                    adj_sp = wall_span(adj, adj_dir)
                    if not adj_sp: continue
                    a_lo, a_hi, a_lo_r, a_hi_r = adj_sp

                    matched = None
                    if abs(a_lo - end_pos) < CORNER_TOL: matched = (a_lo_r, a_hi_r, a_lo, a_hi)
                    elif abs(a_hi - end_pos) < CORNER_TOL: matched = (a_hi_r, a_lo_r, a_hi, a_lo)
                    if not matched: continue

                    near_t = t0 if abs(t0 - end_pos) < abs(t1 - end_pos) else t1
                    far_t  = t1 if near_t == t0 else t0
                    near_t_ref = th_faces[0][0] if th_faces[0][1] == near_t else th_faces[-1][0]
                    far_t_ref  = th_faces[-1][0] if near_t_ref == th_faces[0][0] else th_faces[0][0]

                    adj_start_r, adj_end_r, adj_start_p, adj_end_p = matched

                    ra_c = ReferenceArray()
                    ra_c.Append(far_t_ref)
                    ra_c.Append(near_t_ref)
                    ra_c.Append(adj_end_r)
                    if is_x:
                        cp0 = XYZ(near_coord, far_t,     0)
                        cp1 = XYZ(near_coord, adj_end_p, 0)
                    else:
                        cp0 = XYZ(far_t,     near_coord, 0)
                        cp1 = XYZ(adj_end_p, near_coord, 0)
                    try_dim(cp0, cp1, ra_c, dt_wall)
                    break

run_group(h_walls, XYZ.BasisX, True)
run_group(v_walls, XYZ.BasisY, False)

TransactionManager.Instance.TransactionTaskDone()
OUT = "完成 | 水平RC牆:{} 垂直RC牆:{}".format(len(h_walls), len(v_walls))
# ----------------------------------------
watch = Watch(python_script)
