# Dynamo graph FT-標註[樑]立面.dyn (Dynamo 2.19.3.6394)
# author: CHIUNG YING
# ✨操作說明：需輸入相關資訊

框選_網格_樑 = DSModelElementsSelection()  # 39 picked in the model; graph input
標註類型_key_in = StringInput("FT-DIM-BEAM(TXT_4.0mm)")  # graph input
標註間距_外層_總寬 = DoubleSlider(700, range=0..1000 step 50)  # graph input
標註間距_內層_樑與網格 = DoubleSlider(350, range=0..1000 step 50)  # graph input
最短樑長度_過濾柱邊短樑_0_不過濾 = DoubleSlider(0, range=0..1000 step 50)
y向_總尺寸位置_否_是 = BoolSelector(false)  # graph input
x向_總尺寸位置_否_是 = BoolSelector(false)  # graph input
python_script = Python(IN[0]=框選_網格_樑, IN[1]=標註類型_key_in, IN[2]=標註間距_外層_總寬, IN[3]=標註間距_內層_樑與網格, IN[4]=最短樑長度_過濾柱邊短樑_0_不過濾, IN[5]=y向_總尺寸位置_否_是, IN[6]=x向_總尺寸位置_否_是)  # CPython3
# ---------- python_script.python (255 lines) ----------
import clr
clr.AddReference('RevitAPI')
clr.AddReference('RevitServices')
from Autodesk.Revit.DB import Grid as RevitGrid
from Autodesk.Revit.DB import (
    FilteredElementCollector, DimensionType, Options,
    GeometryInstance, Solid, PlanarFace, Line, XYZ,
    ReferenceArray, Reference, BuiltInCategory, BuiltInParameter,
    UnitUtils, UnitTypeId, Level
)
from RevitServices.Persistence import DocumentManager
from RevitServices.Transactions import TransactionManager
import unicodedata

doc  = DocumentManager.Instance.CurrentDBDocument
view = doc.ActiveView

raw     = IN[0] if isinstance(IN[0], list) else [IN[0]]
dname   = IN[1]
D_FAR   = UnitUtils.ConvertToInternalUnits(float(IN[2] or 400), UnitTypeId.Millimeters)
D_NEAR  = UnitUtils.ConvertToInternalUnits(float(IN[3] or 50),  UnitTypeId.Millimeters)
MIN_LEN = UnitUtils.ConvertToInternalUnits(float(IN[4] or 500), UnitTypeId.Millimeters)
SU = 1.0 if IN[5] else -1.0
SZ = 1.0 if IN[6] else -1.0
PAD = UnitUtils.ConvertToInternalUnits(30.0, UnitTypeId.Millimeters)

def mm(v): return UnitUtils.ConvertToInternalUnits(v, UnitTypeId.Millimeters)
def uw(x): return x.InternalElement if hasattr(x, 'InternalElement') else x

EXCLUDE_KW = [
    unicodedata.normalize('NFC', "\u4e0a\u4e0b\u589e\u6253"),
    unicodedata.normalize('NFC', "\u5074\u589e\u6253"),
]

vright = view.RightDirection
vdir   = view.ViewDirection
view_d = view.Origin.X * vdir.X + view.Origin.Y * vdir.Y

def make_pt(u, z):
    return XYZ(vright.X*u + vdir.X*view_d, vright.Y*u + vdir.Y*view_d, z)

def get_u(pt):
    return pt.X * vright.X + pt.Y * vright.Y

all_levels = list(FilteredElementCollector(doc).OfClass(Level))

def get_nearest_level_ref(z_top):
    best, best_d = None, float('inf')
    for lv in all_levels:
        dz = lv.Elevation - z_top
        if dz < -mm(10):  continue
        if dz >  mm(500): continue
        d = abs(dz)
        if d < best_d:
            best_d = d; best = (lv.Elevation, Reference(lv))
    return best

elev_grids = []
for g in FilteredElementCollector(doc).OfClass(RevitGrid):
    try:
        c  = g.Curve
        p0 = c.GetEndPoint(0); p1 = c.GetEndPoint(1)
        dx = p1.X - p0.X; dy = p1.Y - p0.Y
        hl = (dx*dx + dy*dy) ** 0.5
        if hl < 1e-9: continue
        if abs(dx/hl * vdir.X + dy/hl * vdir.Y) > 0.7:
            elev_grids.append(g)
    except: pass

errors = []
errors.append("vright=(%.2f,%.2f) vdir=(%.2f,%.2f) grids=%d lvl=%d" % (
    vright.X, vright.Y, vdir.X, vdir.Y, len(elev_grids), len(all_levels)))

dim_type = None
for dt in FilteredElementCollector(doc).OfClass(DimensionType).WhereElementIsElementType():
    try:
        if dt.Name == dname: dim_type = dt; break
    except: continue
if dim_type is None:
    for dt in FilteredElementCollector(doc).OfClass(DimensionType).WhereElementIsElementType():
        try:
            p = dt.get_Parameter(BuiltInParameter.ALL_MODEL_TYPE_NAME)
            if p is not None and p.AsString() == dname: dim_type = dt; break
        except: continue
if dim_type is None:
    avail = sorted([dt.Name for dt in
                    FilteredElementCollector(doc).OfClass(DimensionType).WhereElementIsElementType()])
    OUT = [[], ["找不到: «%s»" % dname] + avail]; raise Exception("DimensionType not found")

ACCEPT_CATS = { int(BuiltInCategory.OST_StructuralFraming) }

beams = []
for item in raw:
    e = uw(item)
    if e is None: continue
    cat = e.Category
    if cat is None or cat.Id.IntegerValue not in ACCEPT_CATS:
        errors.append("ID=%d skip Cat=%s" % (e.Id.IntegerValue, cat.Name if cat else "無")); continue
    raw_strs = []
    try:
        sym = e.Symbol; fn = sym.Family.Name; sn = sym.Name
        if fn: raw_strs.append(fn)
        if sn: raw_strs.append(sn)
    except: pass
    try:
        en = e.Name
        if en: raw_strs.append(en)
    except: pass
    try:
        p = e.get_Parameter(BuiltInParameter.ELEM_FAMILY_AND_TYPE_PARAM)
        if p:
            vs = p.AsValueString()
            if vs: raw_strs.append(vs)
    except: pass
    combined_norm = unicodedata.normalize('NFC', " ".join(raw_strs))
    if any(kw in combined_norm for kw in EXCLUDE_KW):
        errors.append("ID=%d skip EXCLUDED" % e.Id.IntegerValue); continue
    loc = e.Location
    if loc is None or not hasattr(loc, 'Curve'):
        errors.append("ID=%d skip 無曲線" % e.Id.IntegerValue); continue
    try:
        ep0 = loc.Curve.GetEndPoint(0); ep1 = loc.Curve.GetEndPoint(1)
        ddx = ep1.X - ep0.X; ddy = ep1.Y - ep0.Y
        ddl_h = (ddx*ddx + ddy*ddy) ** 0.5
        ddl   = (ddx*ddx + ddy*ddy + (ep1.Z-ep0.Z)**2) ** 0.5
    except:
        errors.append("ID=%d skip 端點錯誤" % e.Id.IntegerValue); continue
    if ddl < MIN_LEN:
        errors.append("ID=%d skip 短" % e.Id.IntegerValue); continue
    if ddl_h < mm(50):
        errors.append("ID=%d skip 垂直" % e.Id.IntegerValue); continue
    errors.append("ID=%d PASS [%s]" % (e.Id.IntegerValue, combined_norm[:25]))
    beams.append(e)

errors.append("=== beams=%d  grids=%d ===" % (len(beams), len(elev_grids)))

def get_faces(beam, use_z):
    opt = Options(); opt.ComputeReferences = True
    opt.IncludeNonVisibleObjects = False; opt.View = view
    cands = []
    for g in beam.get_Geometry(opt):
        solids = []
        if isinstance(g, GeometryInstance):
            try:
                for sg in g.GetInstanceGeometry():
                    if isinstance(sg, Solid) and sg.Volume > 1e-9: solids.append(sg)
            except: pass
        elif isinstance(g, Solid) and g.Volume > 1e-9:
            solids.append(g)
        for solid in solids:
            for face in solid.Faces:
                if not isinstance(face, PlanarFace): continue
                fn = face.FaceNormal
                score = abs(fn.Z) if use_z else abs(fn.X*vright.X + fn.Y*vright.Y)
                if score < 0.9: continue
                try:   ref = face.Reference
                except: continue
                if ref is None: continue
                pos = face.Origin.Z if use_z else get_u(face.Origin)
                cands.append((pos, ref))
    if len(cands) < 2: return []
    cands.sort(key=lambda x: x[0])
    return [cands[0], cands[-1]]

def make_dim(refs_list, line):
    if len(refs_list) < 2: return None
    filtered = [refs_list[0]]
    for item in refs_list[1:]:
        if abs(item[0] - filtered[-1][0]) >= mm(1): filtered.append(item)
    if len(filtered) < 2: return None
    ra = ReferenceArray()
    for _, ref in filtered: ra.Append(ref)
    try:   return doc.Create.NewDimension(view, line, ra, dim_type)
    except Exception as ex: return "ERR:" + str(ex)

results = []
TransactionManager.Instance.EnsureInTransaction(doc)

for beam in beams:
    c  = beam.Location.Curve
    cu = (get_u(c.GetEndPoint(0)) + get_u(c.GetEndPoint(1))) / 2.0
    cz = (c.GetEndPoint(0).Z   + c.GetEndPoint(1).Z)   / 2.0
    zf = get_faces(beam, use_z=True)
    ef = get_faces(beam, use_z=False)   # ← 移到最前，縱向也用得到

    # 橫向樑面 u 範圍
    if len(ef) >= 2:
        u_lo = ef[0][0]; u_hi = ef[-1][0]
    else:
        u_lo = cu; u_hi = cu

    # 樓層線（縱向用）
    lv = get_nearest_level_ref(zf[-1][0]) if len(zf) >= 2 else None

    # 橫向標註基準 Z（樑外側面）
    if len(zf) >= 2:
        z_h_base = zf[0][0] if SZ < 0 else zf[-1][0]
    else:
        z_h_base = cz
    z_in  = z_h_base + SZ * D_NEAR
    z_out = z_h_base + SZ * D_FAR

    # ── ① 縱向：以樑外側面起算，保持一致間距 ──────────────────────
    # SU < 0 (←) → 左側面往左  SU > 0 (→) → 右側面往右
    u_line = (u_lo - D_NEAR) if SU < 0 else (u_hi + D_NEAR)

    if len(zf) >= 2:
        v_refs = list(zf) + ([lv] if lv else [])
        v_refs.sort(key=lambda x: x[0])
        ln = Line.CreateBound(make_pt(u_line, v_refs[0][0]-PAD),
                              make_pt(u_line, v_refs[-1][0]+PAD))
        d = make_dim(v_refs, ln)
        (results if d and not isinstance(d, str) else errors).append(d)
    else:
        errors.append("Beam %d: 頂底面未找到" % beam.Id.IntegerValue)

    # ── ② 橫向 ───────────────────────────────────────────────────
    if len(ef) < 2:
        errors.append("Beam %d: 水平面未找到" % beam.Id.IntegerValue)
        continue

    inner = list(ef); has_grid = False
    for g in elev_grids:
        try:
            gc  = g.Curve
            u_g = (get_u(gc.GetEndPoint(0)) + get_u(gc.GetEndPoint(1))) / 2.0
            if u_lo - mm(5) <= u_g <= u_hi + mm(5):
                inner.append((u_g, Reference(g))); has_grid = True
        except: pass

    inner.sort(key=lambda x: x[0])
    inner2 = [inner[0]]
    for f in inner[1:]:
        if abs(f[0] - inner2[-1][0]) >= mm(1): inner2.append(f)

    if has_grid and len(inner2) >= 3:
        ln = Line.CreateBound(make_pt(inner2[0][0]-PAD, z_in),
                              make_pt(inner2[-1][0]+PAD, z_in))
        d = make_dim(inner2, ln)
        (results if d and not isinstance(d, str) else errors).append(d)
        outer = [inner2[0], inner2[-1]]
        if abs(outer[-1][0]-outer[0][0]) > mm(1):
            ln = Line.CreateBound(make_pt(outer[0][0]-PAD, z_out),
                                  make_pt(outer[-1][0]+PAD, z_out))
            d = make_dim(outer, ln)
            (results if d and not isinstance(d, str) else errors).append(d)
    else:
        if abs(u_hi - u_lo) > mm(1):
            ln = Line.CreateBound(make_pt(u_lo-PAD, z_in),
                                  make_pt(u_hi+PAD, z_in))
            d = make_dim(ef, ln)
            (results if d and not isinstance(d, str) else errors).append(d)

TransactionManager.Instance.TransactionTaskDone()
OUT = [results, errors]
# ----------------------------------------
watch = Watch(python_script)
