# Dynamo graph FT-標註[牆] 立面.dyn (Dynamo 2.19.3.6394)
# author: CHIUNG YING
# ✨操作說明：需輸入相關資訊

框選_網格_牆 = DSModelElementsSelection()  # 12 picked in the model; graph input
標註類型_key_in = StringInput("FT-DIM-WALL(TXT_4.0mm)")
間距_外層_總寬總高_預設 = DoubleSlider(1000, range=300..1000 step 100)
標註與牆的間距_預設 = DoubleSlider(300, range=0..1000 step 100)  # graph input
code_block = CodeBlock { 1; }
x向_牆標註位置_否_是 = BoolSelector(true)  # graph input
y向_牆標註位置_否_是 = BoolSelector(false)  # graph input
python_script = Python(IN[0]=框選_網格_牆, IN[1]=標註類型_key_in, IN[2]=間距_外層_總寬總高_預設, IN[3]=標註與牆的間距_預設, IN[4]=code_block, IN[5]=x向_牆標註位置_否_是, IN[6]=y向_牆標註位置_否_是)  # CPython3
# ---------- python_script.python (315 lines) ----------
import math
import clr
clr.AddReference('RevitAPI')
clr.AddReference('RevitServices')

from Autodesk.Revit.DB import (
    FilteredElementCollector, DimensionType, Dimension,
    Options, ViewDetailLevel, GeometryInstance, Solid,
    PlanarFace, Line, XYZ, ReferenceArray, Reference,
    BuiltInCategory, BuiltInParameter, LocationCurve,
    UnitUtils, UnitTypeId, Grid
)
from RevitServices.Persistence import DocumentManager
from RevitServices.Transactions import TransactionManager

doc  = DocumentManager.Instance.CurrentDBDocument
view = doc.ActiveView

raw_elems     = IN[0] if isinstance(IN[0], list) else [IN[0]]
wall_dim_name = IN[1] if IN[1] is not None else "FT-DIM-WALL(TXT_4mm)"
void_dim_name = IN[2] if IN[2] is not None else "FT-DIM-VOID(TXT_4mm)"
dist_near     = float(IN[3]) if IN[3] is not None else 600.0
SIDE_X        = 1 if IN[5] is True else -1
SIDE_Y        = 1 if IN[6] is True else -1

def ft(mm):
    return UnitUtils.ConvertToInternalUnits(mm, UnitTypeId.Millimeters)
def to_mm(v):
    return round(UnitUtils.ConvertFromInternalUnits(v, UnitTypeId.Millimeters), 1)

D_NEAR   = ft(dist_near)
MIN_SPAN = ft(50)
DOOR_WIN_CATS = {int(BuiltInCategory.OST_Doors), int(BuiltInCategory.OST_Windows)}

def unwrap(x):
    return x.InternalElement if hasattr(x, 'InternalElement') else x

def safe_type_name(elem):
    try:
        t = doc.GetElement(elem.GetTypeId())
        if t and t.Name: return t.Name
    except: pass
    try:
        n = elem.Name
        if n: return n
    except: pass
    return ""

all_dt = list(FilteredElementCollector(doc).OfClass(DimensionType).ToElements())
def find_dt(name):
    dt = next((d for d in all_dt if d.get_Parameter(BuiltInParameter.ALL_MODEL_TYPE_NAME).AsString() == name), None)
    return dt or (all_dt[0] if all_dt else None)

dt_wall = find_dt(wall_dim_name)
dt_void = find_dt(void_dim_name)

h_walls = []; v_walls = []
for raw in raw_elems:
    elem = unwrap(raw)
    if elem is None: continue
    try: cat_id = elem.Category.Id.IntegerValue
    except: continue
    if cat_id != int(BuiltInCategory.OST_Walls): continue
    if "RC" not in safe_type_name(elem): continue
    try:
        lc = elem.Location
        if isinstance(lc, LocationCurve):
            p0 = lc.Curve.GetEndPoint(0); p1 = lc.Curve.GetEndPoint(1)
            if abs(p1.X - p0.X) >= abs(p1.Y - p0.Y): h_walls.append(elem)
            else: v_walls.append(elem)
        else: h_walls.append(elem)
    except: h_walls.append(elem)

# ─── 幾何輔助 ───
def collect_solid_faces(geo_iter, normal_dir, out, dot_tol=0.99):
    for g_obj in geo_iter:
        parts = [g_obj]
        if isinstance(g_obj, GeometryInstance):
            try: parts = list(g_obj.GetInstanceGeometry())
            except: continue
        for part in parts:
            if isinstance(part, Solid) and part.Volume > 0:
                for face in part.Faces:
                    if isinstance(face, PlanarFace):
                        dot = face.FaceNormal.Normalize().DotProduct(normal_dir)
                        if abs(dot) > dot_tol:
                            out.append((face.Reference, face.Origin.DotProduct(normal_dir)))

def get_all_faces_sorted(elem, normal_dir, tol_mm=10, dot_tol=0.99):
    opts = Options()
    opts.ComputeReferences = True
    opts.View = view
    faces = []
    try:
        geo = elem.get_Geometry(opts)
        if geo: collect_solid_faces(geo, normal_dir, faces, dot_tol)
    except: pass
    faces.sort(key=lambda x: x[1])
    tol = ft(tol_mm)
    deduped = []
    for f in faces:
        if not deduped or abs(f[1] - deduped[-1][1]) > tol: deduped.append(f)
    return deduped

def get_outer_two(faces):
    return [faces[0], faces[-1]] if len(faces) >= 2 else faces

def find_face_near(faces, target, tol_mm=60):
    tol = ft(tol_mm); best = None; best_d = tol
    for ref, pos in faces:
        d = abs(pos - target)
        if d < best_d: best_d = d; best = ref
    return best

def group_elements(elements, axis, tol=ft(500)):
    groups = []
    for e in elements:
        try: bbox = e.get_BoundingBox(view)
        except: continue
        if not bbox: continue
        pos = ((bbox.Min.Y + bbox.Max.Y) / 2 if axis == 'X'
               else (bbox.Min.X + bbox.Max.X) / 2)
        found = False
        for g in groups:
            if abs(g['pos'] - pos) < tol:
                g['items'].append(e); found = True; break
        if not found: groups.append({'pos': pos, 'items': [e]})
    return groups

def try_dim(p0, p1, ra, dt):
    if ra.Size < 2: return False
    if p0.DistanceTo(p1) < ft(1): return False
    try:
        d = doc.Create.NewDimension(view, Line.CreateBound(p0, p1), ra)
        if d and dt: d.DimensionType = dt
        return True
    except: return False

VERT_DIR = XYZ.BasisZ

def wall_vertical_span(wall, dot_tol=0.98):
    faces = get_all_faces_sorted(wall, VERT_DIR, tol_mm=5, dot_tol=dot_tol)
    outer = get_outer_two(faces)
    if len(outer) < 2: return None
    z_lo, z_hi = outer[0][1], outer[-1][1]
    if (z_hi - z_lo) < MIN_SPAN: return None
    return z_lo, z_hi, outer[0][0], outer[-1][0]

def get_opening_z_refs(wall, all_z_faces, z_lo, z_hi):
    openings = []
    try:
        for ins_id in wall.FindInserts(False, False, False, False):
            ins = doc.GetElement(ins_id)
            if ins is None: continue
            try: ins_cat = ins.Category.Id.IntegerValue
            except: continue
            if ins_cat not in DOOR_WIN_CATS: continue
            try:
                ins_bbox = ins.get_BoundingBox(view) or ins.get_BoundingBox(None)
                if not ins_bbox: continue
                i_zlo = ins_bbox.Min.Z; i_zhi = ins_bbox.Max.Z
                if (i_zhi - i_zlo) < MIN_SPAN: continue
                r_lo = find_face_near(all_z_faces, i_zlo)
                r_hi = find_face_near(all_z_faces, i_zhi)
                if r_lo and r_hi: openings.append((r_lo, r_hi, i_zlo, i_zhi))
            except: continue
    except: pass
    return openings

# ─── Grid 收集 ───
def collect_grid_refs(thick_dir, range_lo, range_hi, margin_mm=10000):
    margin = ft(margin_mm)
    refs = []
    try:
        grids = list(FilteredElementCollector(doc).OfClass(Grid).ToElements())
        for grid in grids:
            try:
                curve = grid.Curve
                gp0 = curve.GetEndPoint(0); gp1 = curve.GetEndPoint(1)
                pos0 = gp0.X * thick_dir.X + gp0.Y * thick_dir.Y
                pos1 = gp1.X * thick_dir.X + gp1.Y * thick_dir.Y
                if abs(pos0 - pos1) > ft(500): continue
                pos = (pos0 + pos1) / 2
                if pos < range_lo - margin or pos > range_hi + margin: continue
                opts = Options()
                opts.ComputeReferences = True
                opts.View = view
                geo = grid.get_Geometry(opts)
                if not geo: continue
                for g_obj in geo:
                    try:
                        ref = g_obj.Reference
                        if ref:
                            refs.append((ref, pos))
                            break
                    except: pass
            except: continue
    except: pass
    return refs

# ─── 清除舊標註 ───
TransactionManager.Instance.EnsureInTransaction(doc)

# ─── 主函式 ───
def run_elevation_dims(walls_list, is_x):
    side       = SIDE_X if is_x else SIDE_Y
    group_axis = 'X' if is_x else 'Y'
    thick_dir  = XYZ.BasisY if is_x else XYZ.BasisX
    groups     = group_elements(walls_list, group_axis)

    # ══ 水平連續標（跨所有牆 + Grid）══
    all_refs   = []
    all_z_mids = []
    all_bases  = []

    for wall in walls_list:
        vsp = wall_vertical_span(wall)
        if not vsp: continue
        all_z_mids.append((vsp[0] + vsp[1]) / 2)
        th_faces = get_all_faces_sorted(wall, thick_dir, tol_mm=5, dot_tol=0.95)
        all_refs.extend(th_faces)
        bb = wall.get_BoundingBox(view)
        if bb:
            if is_x: all_bases.append(bb.Max.Y if side == 1 else bb.Min.Y)
            else:     all_bases.append(bb.Max.X if side == 1 else bb.Min.X)

    if len(all_refs) >= 2 and all_z_mids:
        positions = [p for _, p in all_refs]
        range_lo  = min(positions); range_hi = max(positions)
        grid_refs = collect_grid_refs(thick_dir, range_lo, range_hi)
        all_refs.extend(grid_refs)
        all_refs.sort(key=lambda x: x[1])
        deduped_h = [all_refs[0]]
        for ref, pos in all_refs[1:]:
            if abs(pos - deduped_h[-1][1]) > ft(50):
                deduped_h.append((ref, pos))
        if len(deduped_h) >= 2:
            z_mid = sum(all_z_mids) / len(all_z_mids)
            base  = max(all_bases) if side == 1 else min(all_bases)
            nc    = base + side * D_NEAR
            ra_h  = ReferenceArray()
            for ref, _ in deduped_h: ra_h.Append(ref)
            lo = deduped_h[0][1]; hi = deduped_h[-1][1]
            if is_x:
                hp0 = XYZ(nc, lo, z_mid); hp1 = XYZ(nc, hi, z_mid)
            else:
                hp0 = XYZ(lo, nc, z_mid); hp1 = XYZ(hi, nc, z_mid)
            try_dim(hp0, hp1, ra_h, dt_wall)

    # ══ 縱向標（per-group → per-wall）══
    for group in groups:
        items = group['items']
        bboxes = [i.get_BoundingBox(view) for i in items]
        bboxes = [b for b in bboxes if b]
        if not bboxes: continue
        if is_x:
            base_coord = (max(b.Max.Y for b in bboxes) if side == 1
                          else min(b.Min.Y for b in bboxes))
        else:
            base_coord = (max(b.Max.X for b in bboxes) if side == 1
                          else min(b.Min.X for b in bboxes))
        near_coord = base_coord + side * D_NEAR

        for wall in items:
            bbox = wall.get_BoundingBox(view)
            if not bbox: continue
            vsp = wall_vertical_span(wall)
            if not vsp: continue
            z_lo, z_hi, ref_zlo, ref_zhi = vsp
            all_z_faces = get_all_faces_sorted(wall, VERT_DIR, tol_mm=5, dot_tol=0.95)
            openings = get_opening_z_refs(wall, all_z_faces, z_lo, z_hi)

            # ★ 無開口就不標縱向
            if not openings: continue

            z_refs = [(ref_zlo, z_lo)]
            for r_lo_o, r_hi_o, z_lo_o, z_hi_o in openings:
                z_refs.append((r_lo_o, z_lo_o))
                z_refs.append((r_hi_o, z_hi_o))
            z_refs.append((ref_zhi, z_hi))
            z_refs.sort(key=lambda x: x[1])
            deduped_z = [z_refs[0]]
            for ref, z in z_refs[1:]:
                if abs(z - deduped_z[-1][1]) > ft(50): deduped_z.append((ref, z))
            if len(deduped_z) >= 2:
                ra_z = ReferenceArray()
                for ref, _ in deduped_z: ra_z.Append(ref)
                if is_x:
                    x_mid = (bbox.Min.X + bbox.Max.X) / 2
                    zp0 = XYZ(x_mid, near_coord, deduped_z[0][1])
                    zp1 = XYZ(x_mid, near_coord, deduped_z[-1][1])
                else:
                    y_mid = (bbox.Min.Y + bbox.Max.Y) / 2
                    zp0 = XYZ(near_coord, y_mid, deduped_z[0][1])
                    zp1 = XYZ(near_coord, y_mid, deduped_z[-1][1])
                try_dim(zp0, zp1, ra_z, dt_wall)
            for r_lo_o, r_hi_o, z_lo_o, z_hi_o in openings:
                if (z_hi_o - z_lo_o) < MIN_SPAN: continue
                ra_v = ReferenceArray()
                ra_v.Append(r_lo_o); ra_v.Append(r_hi_o)
                if is_x:
                    x_mid = (bbox.Min.X + bbox.Max.X) / 2
                    vp0 = XYZ(x_mid, near_coord, z_lo_o)
                    vp1 = XYZ(x_mid, near_coord, z_hi_o)
                else:
                    y_mid = (bbox.Min.Y + bbox.Max.Y) / 2
                    vp0 = XYZ(near_coord, y_mid, z_lo_o)
                    vp1 = XYZ(near_coord, y_mid, z_hi_o)
                try_dim(vp0, vp1, ra_v, dt_void)

run_elevation_dims(h_walls, is_x=True)
run_elevation_dims(v_walls, is_x=False)
TransactionManager.Instance.TransactionTaskDone()

OUT = "完成 | H:{} V:{}".format(len(h_walls), len(v_walls))
# ----------------------------------------
watch = Watch(python_script)
