# Dynamo graph FT-標註 [網格]平面 - 複製.dyn "FT-標註 [網格]平面" (Dynamo 2.19.3.6394)
# author: CHIUNG YING
# ✨操作說明：需輸入相關資訊

# group: 備用
# 描述 <按兩下這裡以編輯群組描述>
樓層選取 = Views()  # nothing selected
網格_預設標註型式 = StringInput("FT-DIM(TXT_4mm)")
標註樓層_複製文字用 = StringInput("敷地 \ 開挖面 \ 筏基面 \ GL \ 1F(TOC) \ 1F(TOF)\ B1F(TOC) \ B1F(TOF)")

boolean = BoolSelector(true)

# group: 網格標註型式(預設)
# 描述 <按兩下這裡以編輯群組描述>
string = StringInput("FT-DIM(TXT")
專案標註型式 = Python(IN[0]=string)  # CPython3; graph output
# ---------- 專案標註型式.python (34 lines) ----------
import clr
clr.AddReference('RevitAPI')
from Autodesk.Revit.DB import *
clr.AddReference('RevitServices')
from RevitServices.Persistence import DocumentManager

doc = DocumentManager.Instance.CurrentDBDocument

keyword = IN[0] if IN[0] else ""  # 輸入關鍵字篩選，空字串顯示全部

names = []
for dt in FilteredElementCollector(doc).OfClass(DimensionType):
    name = None
    # 方法1：參數讀取
    for bip in [BuiltInParameter.SYMBOL_NAME_PARAM, BuiltInParameter.ALL_MODEL_TYPE_NAME]:
        try:
            p = dt.get_Parameter(bip)
            if p and p.AsString():
                name = p.AsString()
                break
        except:
            continue
    # 方法2：直接屬性
    if not name:
        try:
            name = dt.Name
        except:
            name = "(id={})".format(dt.Id.IntegerValue)
    
    if keyword.lower() in name.lower():
        names.append(name)

names.sort()
OUT = names
# ----------------------------------------
對應下方線型選入_編號 = DoubleSlider(2, range=0..10 step 1)  # graph input
getItemAtIndex = List.GetItemAtIndex(list=專案標註型式, index=對應下方線型選入_編號)
watch = Watch(專案標註型式)

偏移距離 = DoubleSlider(-100, range=-1000..2000 step 50)  # graph input
是_選取需標註的 = DSModelElementsSelection()  # 1 picked in the model; graph input
否_全標註_是_要選取 = BoolSelector(false)  # graph input
python_script = Python(IN[0]=boolean, IN[1]=getItemAtIndex, IN[2]=偏移距離, IN[3]=是_選取需標註的, IN[4]=否_全標註_是_要選取)  # CPython3
# ---------- python_script.python (96 lines) ----------
import clr
clr.AddReference('RevitAPI')
from Autodesk.Revit.DB import *
clr.AddReference('RevitServices')
from RevitServices.Persistence import DocumentManager
from RevitServices.Transactions import TransactionManager

ui_doc = DocumentManager.Instance.CurrentUIApplication.ActiveUIDocument
doc = ui_doc.Document
active_view = ui_doc.ActiveView

run           = IN[0]
dim_type_name = IN[1] if IN[1] else "FT-DIM(TXT_4mm)"  # ← 新增：手動輸入標註類型名稱
offset_cm     = float(IN[2]) if IN[2] is not None else 100.0
offset_ft     = offset_cm / 30.48
selected      = IN[3] if isinstance(IN[3], list) else [IN[3]]
use_selection = IN[4]

def get_dim_type_name(dt):
    for bip in [BuiltInParameter.SYMBOL_NAME_PARAM, BuiltInParameter.ALL_MODEL_TYPE_NAME]:
        try:
            p = dt.get_Parameter(bip)
            if p and p.AsString():
                return p.AsString()
        except:
            continue
    try:
        return dt.Name
    except:
        return None

if not run:
    OUT = "待機中"
else:
    view = active_view
    if not isinstance(view, ViewPlan):
        OUT = "❌ 請切換至平面視圖再執行"
    else:
        TransactionManager.Instance.EnsureInTransaction(doc)
        try:
            # Step 1：找標註類型
            dim_type = None
            for dt in FilteredElementCollector(doc).OfClass(DimensionType):
                name = get_dim_type_name(dt)
                if name and name == dim_type_name:
                    dim_type = dt
                    break
            if dim_type is None:
                raise Exception("Step1❌ 找不到標註類型「{}」".format(dim_type_name))

            # Step 2：取得軸線
            if use_selection and selected and selected[0] is not None:
                all_grids = [UnwrapElement(e) for e in selected if isinstance(UnwrapElement(e), Grid)]
            else:
                all_grids = list(FilteredElementCollector(doc, view.Id).OfClass(Grid).ToElements())

            # Step 3：分類
            v_grids, h_grids = [], []
            for g in all_grids:
                try:
                    p0, p1 = g.Curve.GetEndPoint(0), g.Curve.GetEndPoint(1)
                    if abs(p0.X - p1.X) < 0.1: v_grids.append(g)
                    elif abs(p0.Y - p1.Y) < 0.1: h_grids.append(g)
                except:
                    continue

            v_grids.sort(key=lambda g: g.Curve.Evaluate(0.5, True).X)
            h_grids.sort(key=lambda g: g.Curve.Evaluate(0.5, True).Y)

            results = ["視圖：{} | 垂直：{} 水平：{}".format(view.Name, len(v_grids), len(h_grids))]
            target_z   = view.Origin.Z
            right_dir  = view.RightDirection.Normalize()
            up_dir     = view.UpDirection.Normalize()

            if len(v_grids) >= 2:
                ra = ReferenceArray()
                for g in v_grids: ra.Append(Reference(g))
                all_y    = [g.Curve.GetEndPoint(i).Y for g in v_grids for i in range(2)]
                line_pt  = XYZ(v_grids[0].Curve.Evaluate(0.5, True).X, max(all_y) + offset_ft, target_z)
                doc.Create.NewDimension(view, Line.CreateUnbound(line_pt, right_dir), ra, dim_type)
                results.append("✅ 橫向：{} 條".format(len(v_grids)))

            if len(h_grids) >= 2:
                ra = ReferenceArray()
                for g in h_grids: ra.Append(Reference(g))
                all_x    = [g.Curve.GetEndPoint(i).X for g in h_grids for i in range(2)]
                line_pt  = XYZ(min(all_x) - offset_ft, h_grids[0].Curve.Evaluate(0.5, True).Y, target_z)
                doc.Create.NewDimension(view, Line.CreateUnbound(line_pt, up_dir), ra, dim_type)
                results.append("✅ 縱向：{} 條".format(len(h_grids)))

            TransactionManager.Instance.TransactionTaskDone()
            OUT = "\n".join(results)

        except Exception as e:
            TransactionManager.Instance.ForceCloseTransaction()
            OUT = "❌ 錯誤原因：" + str(e)
# ----------------------------------------
watch_2 = Watch(python_script)
