# Dynamo graph FT-標註 [網格]立面 - 複製.dyn "FT-標註 [網格]-平立" (Dynamo 2.19.3.6394)
# author: CHIUNG YING
# ✨操作說明：需輸入相關資訊

# group: 備用
# 描述 <按兩下這裡以編輯群組描述>
樓層選取 = Views()  # nothing selected
網格_預設標註型式 = StringInput("FT-DIM(TXT_4mm)")
標註樓層_複製文字用 = StringInput("敷地 \ 開挖面 \ 筏基面 \ GL \ 1F(TOC) \ 1F(TOF)\ B1F(TOC) \ B1F(TOF)")

boolean = BoolSelector(true)

# group: 網格標註型式(預設)
# 描述 <按兩下這裡以編輯群組描述>
string = StringInput("FT-DIM(TXT")
專案標註型式 = Python(IN[0]=string)  # CPython3; graph output
# ---------- 專案標註型式.python (34 lines) ----------
import clr
clr.AddReference('RevitAPI')
from Autodesk.Revit.DB import *
clr.AddReference('RevitServices')
from RevitServices.Persistence import DocumentManager

doc = DocumentManager.Instance.CurrentDBDocument

keyword = IN[0] if IN[0] else ""  # 輸入關鍵字篩選，空字串顯示全部

names = []
for dt in FilteredElementCollector(doc).OfClass(DimensionType):
    name = None
    # 方法1：參數讀取
    for bip in [BuiltInParameter.SYMBOL_NAME_PARAM, BuiltInParameter.ALL_MODEL_TYPE_NAME]:
        try:
            p = dt.get_Parameter(bip)
            if p and p.AsString():
                name = p.AsString()
                break
        except:
            continue
    # 方法2：直接屬性
    if not name:
        try:
            name = dt.Name
        except:
            name = "(id={})".format(dt.Id.IntegerValue)
    
    if keyword.lower() in name.lower():
        names.append(name)

names.sort()
OUT = names
# ----------------------------------------
對應下方線型選入_編號 = DoubleSlider(2, range=0..10 step 1)  # graph input
getItemAtIndex = List.GetItemAtIndex(list=專案標註型式, index=對應下方線型選入_編號)
string_2 = StringInput("FT-DIM(TXT_6mm)")

偏移距離 = DoubleSlider(0, range=0..2000 step 50)
否_任選一個_是_選取需標註 = DSModelElementsSelection()  # 1 picked in the model; graph input
否_全標註_是_要選取 = BoolSelector(true)
立面標註篩選 = StringInput("TOC,開挖,筏基,GL,屋突")  # graph input
python_script = Python(IN[0]=boolean, IN[1]=getItemAtIndex, IN[2]=偏移距離, IN[3]=否_任選一個_是_選取需標註, IN[4]=否_全標註_是_要選取, IN[5]=立面標註篩選)  # CPython3
# ---------- python_script.python (333 lines) ----------
import clr
clr.AddReference('RevitAPI')
from Autodesk.Revit.DB import *
clr.AddReference('RevitServices')
from RevitServices.Persistence import DocumentManager
from RevitServices.Transactions import TransactionManager

ui_doc = DocumentManager.Instance.CurrentUIApplication.ActiveUIDocument
doc    = ui_doc.Document
active_view = ui_doc.ActiveView

run           = IN[0]
dim_type_name = IN[1] if IN[1] else "FT-DIM(TXT_4mm)"
offset_cm     = float(IN[2]) if IN[2] is not None else 50.0
offset_ft     = abs(offset_cm) / 30.48      # 標頭外加距離
selected      = IN[3] if isinstance(IN[3], list) else [IN[3]]
use_selection = IN[4]

raw_kw      = str(IN[5]).strip() if len(IN) > 5 and IN[5] else ""
lv_keywords = [k.strip() for k in raw_kw.split(",") if k.strip()] if raw_kw else []

HEAD_OFFSET_FT = 50.0 / 304.8   # 立面標頭下方 50mm

# ── 工具函式 ─────────────────────────────────────────────────────────────────

def get_dim_type_name(dt):
    for bip in [BuiltInParameter.SYMBOL_NAME_PARAM, BuiltInParameter.ALL_MODEL_TYPE_NAME]:
        try:
            p = dt.get_Parameter(bip)
            if p and p.AsString(): return p.AsString()
        except: continue
    try: return dt.Name
    except: return None

def get_crop_z_range(v):
    try:
        cb = v.CropBox; t = cb.Transform; mn, mx = cb.Min, cb.Max
        zv = [t.OfPoint(XYZ(xi, yi, 0)).Z
              for xi in [mn.X, mx.X]
              for yi in [mn.Y, mx.Y]]
        return min(zv), max(zv)
    except:
        return None, None

def get_grid_head_z(grids, v):
    for etype in [DatumExtentType.ViewSpecific, DatumExtentType.Model]:
        try:
            tops = []
            for g in grids:
                clist = list(g.GetCurvesInView(etype, v))
                if clist:
                    c = clist[0]
                    z0, z1 = c.GetEndPoint(0).Z, c.GetEndPoint(1).Z
                    if abs(z0 - z1) > 0.05:
                        tops.append(max(z0, z1))
            if tops: return max(tops)
        except: continue
    if v.CropBoxActive:
        _, z_max = get_crop_z_range(v)
        if z_max is not None: return z_max
    raise Exception("無法取得標頭高度，請確認裁剪框已啟用")

def get_levels_in_view(all_levels, v, z_min, z_max):
    TOL = 2.0
    result = []
    for lv in all_levels:
        in_view = False
        try:
            vs = list(lv.GetCurvesInView(DatumExtentType.ViewSpecific, v))
            if vs: in_view = True
        except: pass
        if not in_view:
            if z_min is not None:
                in_view = (z_min - TOL <= lv.Elevation <= z_max + TOL)
            else:
                in_view = True
        if in_view:
            result.append(lv)
    return result

def get_level_left_endpoint(levels, v, right_dir):
    min_proj = None
    best_pt  = None
    for lv in levels:
        for etype in [DatumExtentType.ViewSpecific, DatumExtentType.Model]:
            try:
                clist = list(lv.GetCurvesInView(etype, v))
                if not clist: continue
                c = clist[0]
                for i in range(2):
                    ep   = c.GetEndPoint(i)
                    proj = ep.DotProduct(right_dir)
                    if min_proj is None or proj < min_proj:
                        min_proj = proj; best_pt = ep
                break
            except: continue
    return best_pt

def collect_grids(use_sel, selected, doc, v):
    """收集格線並過濾掉非 Grid 元素（FamilyInstance 等）。"""
    if use_sel:
        raw = [UnwrapElement(x) for x in selected if x is not None]
        return [g for g in raw if g is not None and g.GetType().Name == "Grid"]
    else:
        return list(FilteredElementCollector(doc, v.Id).OfClass(Grid).ToElements())

def get_grid_extents_in_view(grids, v, right_v, fwd_v):
    """
    取得所有格線在視圖中實際繪製線段的端點範圍。
    回傳 (min_right, max_right, min_fwd, max_fwd)。
    """
    min_r = max_r = min_f = max_f = None
    for g in grids:
        curve = None
        for etype in [DatumExtentType.ViewSpecific, DatumExtentType.Model]:
            try:
                clist = list(g.GetCurvesInView(etype, v))
                if clist: curve = clist[0]; break
            except: continue
        if curve is None:
            try: curve = g.Curve
            except: continue
        for i in range(2):
            try:
                ep = curve.GetEndPoint(i)
                r  = ep.DotProduct(right_v)
                f  = ep.DotProduct(fwd_v)
                if min_r is None or r < min_r: min_r = r
                if max_r is None or r > max_r: max_r = r
                if min_f is None or f < min_f: min_f = f
                if max_f is None or f > max_f: max_f = f
            except: pass
    return min_r, max_r, min_f, max_f

def make_plan_anchor(r, f, right_v, fwd_v):
    """將 right_v / fwd_v 分量轉回世界座標 XYZ（平面視圖）。"""
    return XYZ(r * right_v.X + f * fwd_v.X,
               r * right_v.Y + f * fwd_v.Y, 0)

# ── 主程式 ───────────────────────────────────────────────────────────────────

if not run:
    OUT = "請將 IN[0] 設為 True 以執行"
else:
    try:
        all_dim_types = FilteredElementCollector(doc).OfClass(DimensionType).ToElements()
        dim_type = None
        for dt in all_dim_types:
            if get_dim_type_name(dt) == dim_type_name:
                dim_type = dt; break
        if dim_type is None:
            OUT = "找不到標註類型：" + dim_type_name
        else:
            v          = active_view
            view_class = v.GetType().Name
            res        = []

            # ──────────────────────────────────────────────────────────────
            # 平面圖
            # ──────────────────────────────────────────────────────────────
            if view_class == "ViewPlan":
                right_v = v.RightDirection
                fwd_v   = XYZ(-right_v.Y, right_v.X, 0)   # 視圖上方向（在平面內）

                grids = collect_grids(use_selection, selected, doc, v)
                res.append("取得格線：{} 條（{}）".format(
                    len(grids), "選取" if use_selection else "全視圖"))

                if len(grids) < 2:
                    OUT = res + ["平面可見軸線不足 2 條，請確認選取了格線（非柱/梁）"]
                else:
                    def is_horiz(g):
                        try:
                            c = g.Curve
                            d = (c.GetEndPoint(1) - c.GetEndPoint(0)).Normalize()
                            return abs(d.DotProduct(right_v)) >= abs(d.DotProduct(fwd_v))
                        except: return False

                    h_grids = sorted([g for g in grids if     is_horiz(g)],
                                     key=lambda g: g.Curve.GetEndPoint(0).DotProduct(fwd_v))
                    v_grids = sorted([g for g in grids if not is_horiz(g)],
                                     key=lambda g: g.Curve.GetEndPoint(0).DotProduct(right_v))

                    TransactionManager.Instance.EnsureInTransaction(doc)

                    # ── H 軸標註（水平格線，量上下間距）────────────────────
                    if len(h_grids) >= 2:
                        refs = ReferenceArray()
                        for g in h_grids: refs.Append(Reference(g))

                        # 取 H 格線在視圖中的實際端部範圍
                        h_min_r, h_max_r, h_min_f, h_max_f = \
                            get_grid_extents_in_view(h_grids, v, right_v, fwd_v)

                        if h_min_r is not None:
                            # 標註線：在最上方格線的頂端（標頭位置）+ offset，水平方向
                            # X 定位在格線最左端（標頭端），Y 定位在最上方端部 + offset
                            anchor = make_plan_anchor(h_min_r, h_max_f + offset_ft, right_v, fwd_v)
                        else:
                            pt     = h_grids[-1].Curve.Evaluate(0.5, True)
                            anchor = XYZ(pt.X + fwd_v.X * offset_ft,
                                         pt.Y + fwd_v.Y * offset_ft, 0)

                        line = Line.CreateUnbound(anchor, right_v)
                        doc.Create.NewDimension(v, line, refs, dim_type)
                        res.append("平面 H軸標註：{} 條".format(len(h_grids)))
                    else:
                        res.append("H軸格線 < 2 條，跳過")

                    # ── V 軸標註（垂直格線，量左右間距）────────────────────
                    if len(v_grids) >= 2:
                        refs = ReferenceArray()
                        for g in v_grids: refs.Append(Reference(g))

                        # 取 V 格線在視圖中的實際端部範圍
                        v_min_r, v_max_r, v_min_f, v_max_f = \
                            get_grid_extents_in_view(v_grids, v, right_v, fwd_v)

                        if v_min_r is not None:
                            # 標註線：在最左格線的左側（標頭位置）- offset，垂直方向
                            # X 定位在最左側端部 - offset，Y 定位在最高端部（標頭位置）
                            anchor = make_plan_anchor(v_min_r - offset_ft, v_max_f, right_v, fwd_v)
                        else:
                            pt     = v_grids[0].Curve.Evaluate(0.5, True)
                            anchor = XYZ(pt.X - right_v.X * offset_ft,
                                         pt.Y - right_v.Y * offset_ft, 0)

                        line = Line.CreateUnbound(anchor, fwd_v)
                        doc.Create.NewDimension(v, line, refs, dim_type)
                        res.append("平面 V軸標註：{} 條".format(len(v_grids)))
                    else:
                        res.append("V軸格線 < 2 條，跳過")

                    TransactionManager.Instance.TransactionTaskDone()
                    OUT = res

            # ──────────────────────────────────────────────────────────────
            # 立面 / 剖面
            # ──────────────────────────────────────────────────────────────
            elif view_class == "ViewSection":
                right_dir = v.RightDirection
                up_dir    = v.UpDirection

                raw_grids = collect_grids(use_selection, selected, doc, v)

                def is_visible_vertical(g):
                    try:
                        c  = g.Curve
                        p0, p1 = c.GetEndPoint(0), c.GetEndPoint(1)
                        return abs(p0.DotProduct(right_dir) - p1.DotProduct(right_dir)) < 0.1
                    except: return False

                elev_grids = [g for g in raw_grids if is_visible_vertical(g)]
                if len(elev_grids) < 2 and use_selection:
                    view_grids = list(FilteredElementCollector(doc, v.Id).OfClass(Grid).ToElements())
                    elev_grids = [g for g in view_grids if is_visible_vertical(g)]

                if len(elev_grids) < 2:
                    OUT = "立面可見軸線不足 2 條（找到 {} 條），ViewDir={}".format(
                        len(elev_grids), v.ViewDirection)
                else:
                    elev_grids.sort(key=lambda g: g.Curve.GetEndPoint(0).DotProduct(right_dir))

                    head_z    = get_grid_head_z(elev_grids, v)
                    head_z_mm = head_z * 304.8
                    dim_z     = head_z - HEAD_OFFSET_FT

                    if head_z_mm > 8000:
                        res.append("警告：標頭高度={:.0f}mm".format(head_z_mm))

                    h_refs = ReferenceArray()
                    for g in elev_grids: h_refs.Append(Reference(g))
                    anchor = elev_grids[0].Curve.GetEndPoint(0)
                    h_line = Line.CreateUnbound(XYZ(anchor.X, anchor.Y, dim_z), right_dir)

                    all_levels = list(FilteredElementCollector(doc).OfClass(Level).ToElements())
                    z_min, z_max = get_crop_z_range(v)
                    if z_min is not None:
                        res.append("裁剪框：{:.0f}mm ~ {:.0f}mm".format(
                            z_min * 304.8, z_max * 304.8))

                    lv_vis = get_levels_in_view(all_levels, v, z_min, z_max)
                    if lv_keywords:
                        lv_vis = [l for l in lv_vis
                                  if any(kw in l.Name for kw in lv_keywords)]
                    lv_vis.sort(key=lambda l: l.Elevation)

                    TransactionManager.Instance.EnsureInTransaction(doc)

                    doc.Create.NewDimension(v, h_line, h_refs, dim_type)
                    res.append("立面水平標註：{} 條軸線".format(len(elev_grids)))

                    if len(lv_vis) >= 2:
                        v_refs = ReferenceArray()
                        for lv in lv_vis:
                            try: v_refs.Append(Reference(lv))
                            except: pass

                        if v_refs.Size >= 2:
                            left_ep = get_level_left_endpoint(lv_vis, v, right_dir)
                            mid_z   = (lv_vis[0].Elevation + lv_vis[-1].Elevation) / 2.0
                            if left_ep is not None:
                                v_base = XYZ(left_ep.X, left_ep.Y, mid_z)
                                res.append("垂直標註線：樓層線端部（自動）")
                            else:
                                g0     = elev_grids[0].Curve.GetEndPoint(0)
                                v_base = XYZ(g0.X - right_dir.X * offset_ft,
                                             g0.Y - right_dir.Y * offset_ft, mid_z)
                                res.append("垂直標註線：IN[2] 備用")

                            v_line = Line.CreateUnbound(v_base, up_dir)
                            doc.Create.NewDimension(v, v_line, v_refs, dim_type)
                            res.append("立面垂直標註：{} 個樓層（{}～{}）".format(
                                len(lv_vis), lv_vis[0].Name, lv_vis[-1].Name))
                            if lv_keywords:
                                res.append("關鍵字：{}".format("、".join(lv_keywords)))
                        else:
                            res.append("樓層參考建立失敗")
                    else:
                        res.append("可見樓層不足 2 個（找到 {} 個）".format(len(lv_vis)))

                    TransactionManager.Instance.TransactionTaskDone()
                    res.append("標頭高度：{:.0f}mm".format(head_z_mm))
                    OUT = res

            else:
                OUT = "不支援的視圖類別：{}".format(view_class)

    except Exception as e:
        import traceback
        try: TransactionManager.Instance.ForceCloseTransaction()
        except: pass
        OUT = "錯誤：" + str(e) + "\n" + traceback.format_exc()
# ----------------------------------------
watch = Watch(python_script)
立面篩選備用文字 = StringInput("TOF")
